# Grasshopper definition extrudevalue.gh (Grasshopper 1.0.7)
# plug-ins: HDMolaGH

box = MolaBox(X1=0, Y1=0, Z1=0, X2=1, Y2=1, Z2=1)
number_slider = Slider(0.1, range=0..1)
grid = SubdivideGrid(MolaMesh=box, U=2, V=2, Iteration=1)
extrude_tapered = SubdivideExtrudeTapered(MolaMesh=grid, Height=Slider(1.5, range=0..2), Fraction=Slider(0.8, range=0..1), Cap=True, Iteration=1)
explode = MeshExplode(MolaMesh=grid)
catmullclark = SubdivideCatmullClark(MolaMesh=extrude_tapered, Iteration=1)
extrude_tapered_2 = SubdivideExtrudeTapered(MolaMesh=catmullclark, Height=Slider(0, range=0..100), Fraction=0.5, Cap=Toggle(False), Iteration=1)
catmullclark_2 = SubdivideCatmullClark(MolaMesh=extrude_tapered_2, Iteration=1)
offset_face = SubdivideOffsetFace(MolaMesh=catmullclark_2, Offset=Slider(0.1, range=0..0.1), CloseBorders=True, Iteration=1)
catmullclark_3 = SubdivideCatmullClark(MolaMesh=offset_face, Iteration=1)
to_rhino = MolaToRhino(MolaMesh=catmullclark_2, WithColor=Toggle(True))
number_slider_2 = Slider(1, range=0..1)
torus = MolaTorus(R1=Slider(2, range=0..10), R2=1, RingN=Slider(45, range=0..100), TubeN=Slider(15, range=0..100))
grid_2 = SubdivideGrid(MolaMesh=torus, U=number_slider_2, V=number_slider_2, Iteration=1)
face_location = AnalyzeFaceLocation(MolaMesh=grid_2)
pdecon = Deconstruct(Point=face_location)  # -> XComponent, YComponent, ZComponent
bnd = Bounds(Numbers=pdecon.XComponent)
panel = Panel(bnd)
graph = GraphMapper(
    pdecon.XComponent,
    x0=-2.9366,
    x1=2.9366,
    y0=0,
    y1=1,
    A=1,
    B=0,
    container_name="Linear",
    Graph_x0=0.25,
    Graph_x1=0.75,
    Graph_y0=0.25,
    Graph_y1=0.75)
extrude_point_center_with_values = SubdivideExtrudeToPointCenterWithValues(MolaMesh=grid_2, HeightValues=graph, Iteration=1)
face_area = AnalyzeFaceArea(MolaMesh=extrude_point_center_with_values)
color = ColorMesh(
    MolaMesh=extrude_point_center_with_values,
    Mode=2,
    SingleColor=RGB(255, 254, 254),
    ColorList=RGB(255, 254, 254),
    ValueList=face_area)
to_rhino_2 = MolaToRhino(MolaMesh=extrude_point_center_with_values, WithColor=Toggle(True))
