# Grasshopper definition BuildingG.gh (Grasshopper 1.0.7)
# plug-ins: HDMolaGH

number_slider = Slider(13, range=0..100)
number_slider_2 = Slider(18, range=0..100)
number_slider_3 = Slider(120, range=0..200)
number_slider_4 = Slider(34, range=0..100)
cone = MolaCone(
    Z1=0,
    Z2=number_slider_3,
    R1=number_slider_2,
    R2=number_slider_2,
    Segments=number_slider,
    CapBottom=Toggle(False),
    CapTop=True)
multiplication = Multiplication(A=number_slider, B=number_slider_4)
grid = SubdivideGrid(MolaMesh=cone, U=Slider(1, range=0..1), V=number_slider_4, Iteration=1)
addition = Addition(A=number_slider, B=Slider(3, range=0..10))
face_modulo = AnalyzeFaceModulo(MolaMesh=grid, Modulo=addition, N=0)
face_modulo_2 = AnalyzeFaceModulo(MolaMesh=grid, Modulo=addition, N=1)
face_modulo_3 = AnalyzeFaceModulo(MolaMesh=grid, Modulo=addition, N=2)
face_modulo_4 = AnalyzeFaceModulo(MolaMesh=grid, Modulo=addition, N=3)
split = MeshSplit(MolaMesh=grid, BooleanList=face_modulo)  # -> MolaMesh1, MolaMesh2
split_2 = MeshSplit(MolaMesh=grid, BooleanList=face_modulo_2)  # -> MolaMesh1, MolaMesh2
split_3 = MeshSplit(MolaMesh=grid, BooleanList=face_modulo_3)  # -> MolaMesh1, MolaMesh2
split_4 = MeshSplit(MolaMesh=grid, BooleanList=face_modulo_4)  # -> MolaMesh1, MolaMesh2
join = MeshJoin(MolaMeshes=[split.MolaMesh1, split_2.MolaMesh1, split_3.MolaMesh1, split_4.MolaMesh1])
number_slider_5 = Slider(5, range=0..10)
to_rhino = MolaToRhino(MolaMesh=split_3.MolaMesh1, WithColor=True)
topology = UpdateTopology(MolaMesh=join)
offset_face = SubdivideOffsetFace(MolaMesh=topology, Offset=Slider(8, range=0..10), CloseBorders=True, Iteration=1)
neg = Negative(Value=Slider(20, range=0..20))
cone_2 = MolaCone(Z1=0, Z2=number_slider_3, R1=number_slider_5, R2=number_slider_5, Segments=6, CapBottom=True, CapTop=True)
offset_face_2 = SubdivideOffsetFace(MolaMesh=split_3.MolaMesh1, Offset=neg, CloseBorders=True, Iteration=1)
join_2 = MeshJoin(MolaMeshes=flatten([offset_face, offset_face_2, cone_2]))
topology_2 = UpdateTopology(MolaMesh=join_2)
face_location = AnalyzeFaceLocation(MolaMesh=topology_2)
pdecon = Deconstruct(Point=face_location)  # -> XComponent, YComponent, ZComponent
sqr = Square(Value=pdecon.XComponent)
sqr_2 = Square(Value=pdecon.YComponent)
addition_2 = Addition(A=sqr, B=sqr_2)
larger = LargerThan(FirstNumber=addition_2, SecondNumber=Slider(600, range=0..1000))  # -> LargerThan, OrEqualTo
split_5 = MeshSplit(MolaMesh=topology_2, BooleanList=larger.LargerThan)  # -> MolaMesh1, MolaMesh2
grid_2 = SubdivideGrid(MolaMesh=split_5.MolaMesh1, U=Slider(8, range=0..10), V=2, Iteration=1)
extrude_tapered = SubdivideExtrudeTapered(MolaMesh=grid_2, Height=Slider(0, range=0..100), Fraction=Slider(0.2, range=0..1), Cap=True, Iteration=1)
face_modulo_5 = AnalyzeFaceModulo(MolaMesh=extrude_tapered, Modulo=5, N=4)
split_6 = MeshSplit(MolaMesh=extrude_tapered, BooleanList=face_modulo_5)  # -> MolaMesh1, MolaMesh2
join_3 = MeshJoin(MolaMeshes=[split_5.MolaMesh2, split_6.MolaMesh2])
to_rhino_2 = MolaToRhino(MolaMesh=join_3, WithColor=True)
color = ColorMesh(
    MolaMesh=split_6.MolaMesh1,
    Mode=0,
    SingleColor=ColourSwatch(SwatchColor=RGB(0, 32, 191)),
    ColorList=RGB(255, 255, 255),
    ValueList=0)
to_rhino_3 = MolaToRhino(MolaMesh=color, WithColor=True)
