# Grasshopper definition VoxelOptimiseExample.gh (Grasshopper 1.0.7)
# plug-ins: HDMolaGH

c_script = CSharpScript(
    res=Slider(100, range=0..100),
    ratio=Slider(0.5, range=0..1),
    seed=Slider(5, range=0..10),
    iter=Slider(100000, range=0..100000),
    Reference=["/Users/yang/GitHub/20231205_MolaGH/install/netstandard.dll", "/Users/yang/GitHub/20231205_MolaGH/install/HDMola.dll"])  # -> out, A; inputs res: Int32, ratio: Double, seed: Int32, iter: Int32
# ---------- c_script: C# usings ----------
using Mola;
# ---------- c_script: C# ----------
// initialize
MolaGrid<bool> grid = new MolaGrid<bool>(res, res, 1);
var rand = new Random(seed);
for (int x = 0; x < res; x++)
{
    for (int y = 0; y < res; y++)
    {
        if(rand.NextDouble()>(float)ratio)
        {
            grid.SetValue(x, y, 0, true);
            }
        }
    }

// evelution
for(int i=0;i<iter;i++){
    int rx1 = rand.Next(1, res-1);
    int ry1 = rand.Next(1, res-1);
    int rx2 = rand.Next(1, res-1);
    int ry2 = rand.Next(1, res-1);

    bool cell1 = grid.GetValue(rx1, ry1, 0);
    bool cell2 = grid.GetValue(rx2, ry2, 0);

    int fitness1 = CountSameNbs(grid, rx1, ry1, cell1);
    int fitness2 = CountSameNbs(grid, rx2, ry2, cell2);
    int totalFitness = fitness1 + fitness2;

    bool temp = cell1;
    grid.SetValue(rx1, ry1, 0, cell2);
    grid.SetValue(rx2, ry2, 0, temp);

    cell1 = grid.GetValue(rx1, ry1, 0);
    cell2 = grid.GetValue(rx2, ry2, 0);

    fitness1 = CountSameNbs(grid, rx1, ry1, cell1);
    fitness2 = CountSameNbs(grid, rx2, ry2, cell2);
    int newFitness = fitness1 + fitness2;

    if(newFitness < totalFitness)
    {
        temp = cell1;
        grid.SetValue(rx1, ry1, 0, cell2);
        grid.SetValue(rx2, ry2, 0, temp);

        }
}

//to mesh
MolaMesh mesh = UtilsGrid.VoxelMesh(grid);
A = mesh;
# ---------- c_script: C# additional code ----------
int CountSameNbs(MolaGrid<bool> grid, int x, int y, bool value)
{
    int countNbs = 0;
    if(grid.GetValue(x-1, y, 0) == value)
    {
        countNbs += 1;
        }
        if(grid.GetValue(x+1, y, 0) == value)
    {
        countNbs += 1;
        }
        if(grid.GetValue(x, y-1, 0) == value)
    {
        countNbs += 1;
        }
        if(grid.GetValue(x, y+1, 0) == value)
    {
        countNbs += 1;
        }
        return countNbs;
    }
# ---------- end c_script ----------
to_rhino = MolaToRhino(MolaMesh=c_script.A, WithColor=False)
