# Grasshopper definition CreateIconMap.gh (Grasshopper 0.9.71)

int = Integer(5)
vb = VBScript(file="%desktop%\iconmap.png", columns=int)
# ---------- vb: VB ----------
    file = file.Replace("%desktop%", Environment.GetFolderPath(Environment.SpecialFolder.Desktop))
    file = file.Replace("%documents%", Environment.GetFolderPath(Environment.SpecialFolder.MyDocuments))
    file = file.Replace("%pictures%", Environment.GetFolderPath(Environment.SpecialFolder.MyPictures))

    Dim map As New List(Of MapEntry)

    For Each proxy As IGH_ObjectProxy In Grasshopper.Instances.ComponentServer.ObjectProxies
      If (proxy.Exposure = GH_Exposure.hidden) Then Continue For
      If (proxy.Obsolete ) Then Continue For

      Dim entry As New MapEntry()
      entry.Icon = proxy.Icon
      entry.Name = proxy.Desc.Name

      map.Add(entry)
    Next

    Dim rows As Int32 = Convert.ToInt32(Math.Ceiling(map.Count / columns))
    Dim width As Int32 = 200
    Dim height As Int32 = 26
    Dim image As New Bitmap(columns * width, rows * height, System.Drawing.Imaging.PixelFormat.Format24bppRgb)
    Dim g As Graphics = Graphics.FromImage(image)
    g.Clear(Color.White)

    Dim c As Int32 = -1
    Dim r As int32 = 0
    For Each entry As MapEntry In map
      c += 1
      If (c >= columns) Then
        c = 0
        r += 1
      End If

      Dim rec As New Rectangle(c * width, r * height, width, height)
      Dim iconRec As Rectangle = rec
      iconRec.Width = height
      Dim nameRec As Rectangle = rec
      nameRec.Width -= height + 4
      nameRec.X += height + 4

      GUI.GH_GraphicsUtil.RenderCenteredIcon(g, iconRec, entry.Icon)
      g.DrawString(entry.Name, GH_FontServer.Standard, Brushes.Black, nameRec, GUI.GH_TextRenderingConstants.NearCenter)

      'g.DrawRectangle(Pens.Black, rec)
    Next


    g.Dispose()

    image.Save(file)
    image.Dispose()
# ---------- vb: VB additional code ----------
  Private Class MapEntry
    Public Icon As Bitmap
    Public Name As String
  End Class
# ---------- end vb ----------
