# Grasshopper definition 00_gallery.gh (Grasshopper 1.0.7)
# plug-ins: HDMolaGH

# ---- group: 1-Primitives
tetrahedron = MolaTetrahedron(X1=0, Y1=0, Z1=0, Radius=1)
octahedron = MolaOctahedron(X1=0, Y1=0, Z1=0, Radius=1)
dodecahedron = MolaDodecahedron(X1=0, Y1=0, Z1=0, Radius=1)
cone = MolaCone(Z1=0, Z2=1, R1=2, R2=1, Segments=6, CapBottom=True, CapTop=True)
icosahedron = MolaIcosahedron(X1=0, Y1=0, Z1=0, Radius=1)
quad = MolaQuad(X1=0, Y1=0, Z1=0, X2=1, Y2=0, Z2=0, X3=1, Y3=1, Z3=0, X4=0, Y4=1, Z4=0)
circle = MolaCircle(X=0, Y=0, Z=0, Radius=1, Segments=6)
torus = MolaTorus(R1=3, R2=1, RingN=6, TubeN=6)
box = MolaBox(X1=0, Y1=0, Z1=0, X2=1, Y2=1, Z2=1)
rhombicdodecahedron = MolaRhombicDodecahedron(X1=0, Y1=0, Z1=0, Radius=1)
sphere = MolaSphere(Radius=1, X=0, Y=0, Z=0, URes=10, VRes=10)

# ----
merge = Merge(
    Data1=quad,
    Data2=box,
    Data3=circle,
    Data4=sphere,
    Data5=cone,
    Data6=torus,
    Data7=tetrahedron,
    Data8=octahedron,
    Data9=dodecahedron,
    Data10=rhombicdodecahedron,
    Data11=icosahedron)
to_rhino = MolaToRhino(MolaMesh=merge, WithColor=True)

lng = ListLength(List=to_rhino)

series = Series(Start=0, Step=Slider(10, range=0..10), Count=lng)
vec = VectorXYZ(XComponent=series, YComponent=0, ZComponent=0)  # -> Vector, Length
move = Move(Geometry=to_rhino, Motion=vec.Vector)  # -> Geometry, Transform

# ---- group: 2-Subdivisions
to_mola = RhinoToMola(RhinoMesh=move.Geometry)
number_slider = Slider(1, range=0..3)
split = SplitList(List=series, Index=1)  # -> ListA, ListB
vec_2 = VectorXYZ(XComponent=0, YComponent=graft(split.ListB), ZComponent=0)  # -> simplify(Vector), Length
relative = SubdivideRelative(MolaMesh=to_mola, StartDiriection=0, MinSplit1=0.1, MaxSplit1=0.9, MinSplit2=0.1, MaxSplit2=0.9, Iteration=number_slider)
offset_face = SubdivideOffsetFace(MolaMesh=to_mola, Offset=0.2, CloseBorders=True, Iteration=number_slider)
offset = SubdivideOffset(MolaMesh=to_mola, Offset=0.1, Iteration=number_slider)
split_roof = SubdivideSplitRoof(MolaMesh=to_mola, Height=1, Iteration=number_slider)
extrude = SubdivideExtrude(MolaMesh=to_mola, Height=1, Cap=True, Iteration=number_slider)
split_frame = SubdivideSplitFrame(MolaMesh=to_mola, Witdh=0.2, Iteration=number_slider)
extrude_tapered = SubdivideExtrudeTapered(MolaMesh=to_mola, Height=1, Fraction=0.5, Cap=True, Iteration=number_slider)
extrude_point_center = SubdivideExtrudeToPointCenter(MolaMesh=to_mola, Height=1, Iteration=number_slider)
grid = SubdivideGrid(MolaMesh=to_mola, U=2, V=2, Iteration=number_slider)
catmullclark = SubdivideCatmullClark(MolaMesh=to_mola, Iteration=number_slider)
merge_2 = Merge(
    Data1=graft(catmullclark),
    Data2=graft(extrude),
    Data3=graft(extrude_tapered),
    Data4=graft(extrude_point_center),
    Data5=graft(grid),
    Data6=graft(offset),
    Data7=graft(offset_face),
    Data8=graft(relative),
    Data9=graft(split_frame),
    Data10=graft(split_roof))
flip = FlipMatrix(Data=merge_2)
to_rhino_2 = MolaToRhino(MolaMesh=flip, WithColor=True)
move_2 = Move(Geometry=simplify(to_rhino_2), Motion=vec_2.Vector)  # -> Geometry, Transform
