# Grasshopper definition 01_subdivide_from_quad.gh (Grasshopper 1.0.7)
# plug-ins: HDMolaGH

number_slider = Slider(650, range=0..1000)
number_slider_2 = Slider(1300, range=0..10000)
quad = MolaQuad(
    X1=0,
    Y1=0,
    Z1=0,
    X2=number_slider_2,
    Y2=0,
    Z2=0,
    X3=number_slider_2,
    Y3=number_slider,
    Z3=0,
    X4=0,
    Y4=number_slider,
    Z4=0)
number_slider_3 = Slider(0.6, range=0..1)
number_slider_4 = Slider(0.4, range=0..1)
relative = SubdivideRelative(
    MolaMesh=quad,
    StartDiriection=0,
    MinSplit1=number_slider_4,
    MaxSplit1=number_slider_4,
    MinSplit2=number_slider_3,
    MaxSplit2=number_slider_3,
    Iteration=Slider(5, range=0..10))
offset = SubdivideOffset(MolaMesh=relative, Offset=Slider(-6, range=-10..-5), Iteration=1)
mola_to_rhino = MolaToRhino(MolaMesh=offset, WithColor=True)
