# Grasshopper definition 02_subidivide_from_single_cube.gh (Grasshopper 1.0.7)
# plug-ins: HDMolaGH

box = MolaBox(X1=0, Y1=0, Z1=0, X2=1, Y2=1, Z2=1)
grid = SubdivideGrid(MolaMesh=box, U=2, V=2, Iteration=1)
extrude_tapered = SubdivideExtrudeTapered(MolaMesh=grid, Height=Slider(1.5, range=0..2), Fraction=Slider(0.9, range=0..1), Cap=True, Iteration=1)
extrude_tapered_2 = SubdivideExtrudeTapered(
    MolaMesh=extrude_tapered,
    Height=Slider(0, range=0..100),
    Fraction=Slider(0.2, range=0..1),
    Cap=Toggle(False),
    Iteration=1)
offset_face = SubdivideOffsetFace(MolaMesh=extrude_tapered_2, Offset=Slider(0.1, range=0..0.1), CloseBorders=True, Iteration=1)
catmullclark = SubdivideCatmullClark(MolaMesh=offset_face, Iteration=1)
to_rhino = MolaToRhino(MolaMesh=catmullclark, WithColor=Toggle(True))
