# Grasshopper definition 03_subdivide_by_value.gh (Grasshopper 1.0.7)
# plug-ins: HDMolaGH

number_slider = Slider(1, range=0..1)
torus = MolaTorus(R1=Slider(2, range=0..10), R2=1, RingN=Slider(45, range=0..100), TubeN=Slider(15, range=0..100))
grid = SubdivideGrid(MolaMesh=torus, U=number_slider, V=number_slider, Iteration=1)
face_location = AnalyzeFaceLocation(MolaMesh=grid)
pdecon = Deconstruct(Point=face_location)  # -> XComponent, YComponent, ZComponent
bnd = Bounds(Numbers=pdecon.XComponent)
graph = GraphMapper(
    pdecon.XComponent,
    x0=-2.9366,
    x1=2.9366,
    y0=0,
    y1=1,
    A=0.9971112609,
    B=0.002888739109,
    container_name="Linear",
    Graph_x0=0,
    Graph_x1=1,
    Graph_y0=0.002888739109,
    Graph_y1=1)
panel = Panel(bnd)
extrude_point_center_with_values = SubdivideExtrudeToPointCenterWithValues(MolaMesh=grid, HeightValues=graph, Iteration=1)
color = ColorMesh(MolaMesh=grid, Mode=2, SingleColor=RGB(255, 254, 254), ColorList=RGB(255, 254, 254), ValueList=graph)
unit_x = UnitX(Factor=8)
to_rhino = MolaToRhino(MolaMesh=extrude_point_center_with_values, WithColor=Toggle(True))
to_rhino_2 = MolaToRhino(MolaMesh=color, WithColor=Toggle(True))
move = Move(Geometry=to_rhino, Motion=unit_x)  # -> Geometry, Transform
