# Grasshopper definition 04_subdivide_by_filter.gh (Grasshopper 1.0.7)
# plug-ins: HDMolaGH

number_slider = Slider(650, range=0..1000)
number_slider_2 = Slider(1300, range=0..10000)
quad = MolaQuad(
    X1=0,
    Y1=0,
    Z1=0,
    X2=number_slider_2,
    Y2=0,
    Z2=0,
    X3=number_slider_2,
    Y3=number_slider,
    Z3=0,
    X4=0,
    Y4=number_slider,
    Z4=0)
number_slider_3 = Slider(0.6, range=0..1)
number_slider_4 = Slider(0.4, range=0..1)
relative = SubdivideRelative(
    MolaMesh=quad,
    StartDiriection=0,
    MinSplit1=number_slider_4,
    MaxSplit1=number_slider_4,
    MinSplit2=number_slider_3,
    MaxSplit2=number_slider_3,
    Iteration=Slider(5, range=0..10))
offset = SubdivideOffset(MolaMesh=relative, Offset=Slider(-10, range=-10..-5), Iteration=1)
face_modulo = AnalyzeFaceModulo(MolaMesh=offset, Modulo=5, N=4)
split = MeshSplit(MolaMesh=offset, BooleanList=face_modulo)  # -> MolaMesh1, MolaMesh2

color = ColorMesh(
    MolaMesh=split.MolaMesh2,
    Mode=0,
    SingleColor=ColourSwatch(SwatchColor=RGB(0, 0, 0)),
    ColorList=RGB(255, 255, 255),
    ValueList=0)
to_rhino = MolaToRhino(MolaMesh=color, WithColor=True)

analyze_face_modulo = AnalyzeFaceModulo(MolaMesh=split.MolaMesh1, Modulo=Slider(4, range=0..10), N=Slider(0, range=0..100))
mesh_split = MeshSplit(MolaMesh=split.MolaMesh1, BooleanList=analyze_face_modulo)  # -> MolaMesh1, MolaMesh2

color_2 = ColorMesh(
    MolaMesh=mesh_split.MolaMesh1,
    Mode=0,
    SingleColor=ColourSwatch(SwatchColor=RGB(25, 143, 21)),
    ColorList=RGB(255, 255, 255),
    ValueList=0)
to_rhino_2 = MolaToRhino(MolaMesh=color_2, WithColor=True)

analyze_molamesh = AnalyzeMolaMesh(MolaMesh=mesh_split.MolaMesh2)  # -> VerticeCount, FaceCount
random = Random(Range="10 to 400", Number=analyze_molamesh.FaceCount, Seed=Slider(5, range=0..10))
repeat_data = RepeatData(Data=Toggle(True), Length=analyze_molamesh.FaceCount)
subdivide_extrude_values = SubdivideExtrudeValues(MolaMesh=mesh_split.MolaMesh2, HeightValues=random, Cap=repeat_data, Iteration=1)
analyze_face_normal = AnalyzeFaceNormal(MolaMesh=subdivide_extrude_values)
deconstruct = Deconstruct(Point=analyze_face_normal)  # -> XComponent, YComponent, ZComponent
equality = Equality(FirstNumber=deconstruct.ZComponent, SecondNumber=0)  # -> Equality, Inequality
mesh_split_2 = MeshSplit(MolaMesh=subdivide_extrude_values, BooleanList=equality.Equality)  # -> MolaMesh1, MolaMesh2
number_slider_5 = Slider(5, range=0..10)
to_rhino_3 = MolaToRhino(MolaMesh=mesh_split_2.MolaMesh2, WithColor=True)
subdivide_grid = SubdivideGrid(MolaMesh=mesh_split_2.MolaMesh1, U=number_slider_5, V=number_slider_5, Iteration=1)
subdivide_extrude_tapered = SubdivideExtrudeTapered(MolaMesh=subdivide_grid, Height="0", Fraction="0.2", Cap=True, Iteration=1)
analyze_face_modulo_2 = AnalyzeFaceModulo(MolaMesh=subdivide_extrude_tapered, Modulo=5, N=4)
mesh_split_3 = MeshSplit(MolaMesh=subdivide_extrude_tapered, BooleanList=analyze_face_modulo_2)  # -> MolaMesh1, MolaMesh2

color_3 = ColorMesh(
    MolaMesh=mesh_split_3.MolaMesh1,
    Mode=0,
    SingleColor=ColourSwatch(SwatchColor=RGB(21, 54, 143)),
    ColorList=RGB(255, 255, 255),
    ValueList=0)
to_rhino_4 = MolaToRhino(MolaMesh=color_3, WithColor=True)

to_rhino_5 = MolaToRhino(MolaMesh=mesh_split_3.MolaMesh2, WithColor=True)
