# Grasshopper definition 05_subdivide_by_random_filter.gh (Grasshopper 1.0.7)
# plug-ins: HDMolaGH

number_slider = Slider(10, range=0..10)
box = MolaBox(X1=0, Y1=0, Z1=0, X2=number_slider, Y2=number_slider, Z2=number_slider)

analyze_mesh = AnalyzeMolaMesh(MolaMesh=box)  # -> VerticeCount, FaceCount
random = Random(Range=Domain(0, 1), Number=analyze_mesh.FaceCount, Seed=2)
larger = LargerThan(FirstNumber=random, SecondNumber=Slider(0.6, range=0..1))  # -> LargerThan, OrEqualTo
split = MeshSplit(MolaMesh=box, BooleanList=larger.LargerThan)  # -> MolaMesh1, MolaMesh2
extrude = SubdivideExtrude(MolaMesh=split.MolaMesh1, Height=Slider(10, range=0..10), Cap=True, Iteration=1)

join = MeshJoin(MolaMeshes=[split.MolaMesh2, extrude])

analyze_mesh_2 = AnalyzeMolaMesh(MolaMesh=join)  # -> VerticeCount, FaceCount
random_2 = Random(Range=Domain(0, 1), Number=analyze_mesh_2.FaceCount, Seed=2)
larger_2 = LargerThan(FirstNumber=random_2, SecondNumber=Slider(0.7, range=0..1))  # -> LargerThan, OrEqualTo
split_2 = MeshSplit(MolaMesh=join, BooleanList=larger_2.LargerThan)  # -> MolaMesh1, MolaMesh2
extrude_2 = SubdivideExtrude(MolaMesh=split_2.MolaMesh1, Height=Slider(10, range=0..10), Cap=True, Iteration=1)

number_slider_2 = Slider(4, range=0..10)
join_2 = MeshJoin(MolaMeshes=[split_2.MolaMesh2, extrude_2])
number_slider_3 = Slider(5, range=0..10)
number_slider_4 = Slider(2.5, range=0..10)

analyze_mesh_3 = AnalyzeMolaMesh(MolaMesh=join_2)  # -> VerticeCount, FaceCount
random_3 = Random(Range=Domain(0, 1), Number=analyze_mesh_3.FaceCount, Seed=2)
larger_3 = LargerThan(FirstNumber=random_3, SecondNumber=Slider(0.5, range=0..1))  # -> LargerThan, OrEqualTo
split_3 = MeshSplit(MolaMesh=join_2, BooleanList=larger_3.LargerThan)  # -> MolaMesh1, MolaMesh2
extrude_3 = SubdivideExtrude(MolaMesh=split_3.MolaMesh1, Height=Slider(10, range=0..10), Cap=True, Iteration=1)

join_3 = MeshJoin(MolaMeshes=[split_3.MolaMesh2, extrude_3])

analyze_mesh_4 = AnalyzeMolaMesh(MolaMesh=join_3)  # -> VerticeCount, FaceCount
random_4 = Random(Range=Domain(0, 1), Number=analyze_mesh_4.FaceCount, Seed=2)
larger_4 = LargerThan(FirstNumber=random_4, SecondNumber=Slider(0.9, range=0..1))  # -> LargerThan, OrEqualTo
split_4 = MeshSplit(MolaMesh=join_3, BooleanList=larger_4.LargerThan)  # -> MolaMesh1, MolaMesh2
extrude_4 = SubdivideExtrude(MolaMesh=split_4.MolaMesh1, Height=Slider(10, range=0..10), Cap=True, Iteration=1)

join_4 = MeshJoin(MolaMeshes=[extrude_4, split_4.MolaMesh2])

analyze_mesh_5 = AnalyzeMolaMesh(MolaMesh=join_4)  # -> VerticeCount, FaceCount
random_5 = Random(Range=Domain(0, 1), Number=analyze_mesh_5.FaceCount, Seed=2)
larger_5 = LargerThan(FirstNumber=random_5, SecondNumber=Slider(0.8, range=0..1))  # -> LargerThan, OrEqualTo
split_5 = MeshSplit(MolaMesh=join_4, BooleanList=larger_5.LargerThan)  # -> MolaMesh1, MolaMesh2

grid = SubdivideGrid(MolaMesh=split_5.MolaMesh1, U=number_slider_2, V=number_slider_2, Iteration=1)

analyze_mesh_6 = AnalyzeMolaMesh(MolaMesh=grid)  # -> VerticeCount, FaceCount
random_6 = Random(Range=Domain(0, 1), Number=analyze_mesh_6.FaceCount, Seed=2)
larger_6 = LargerThan(FirstNumber=random_6, SecondNumber=Slider(0.6, range=0..1))  # -> LargerThan, OrEqualTo
split_6 = MeshSplit(MolaMesh=grid, BooleanList=larger_6.LargerThan)  # -> MolaMesh1, MolaMesh2
extrude_5 = SubdivideExtrude(MolaMesh=split_6.MolaMesh1, Height=number_slider_4, Cap=True, Iteration=1)

join_5 = MeshJoin(MolaMeshes=[split_6.MolaMesh2, extrude_5])

analyze_mesh_7 = AnalyzeMolaMesh(MolaMesh=join_5)  # -> VerticeCount, FaceCount
random_7 = Random(Range=Domain(0, 1), Number=analyze_mesh_7.FaceCount, Seed=2)
larger_7 = LargerThan(FirstNumber=random_7, SecondNumber=Slider(0.7, range=0..1))  # -> LargerThan, OrEqualTo
split_7 = MeshSplit(MolaMesh=join_5, BooleanList=larger_7.LargerThan)  # -> MolaMesh1, MolaMesh2
extrude_6 = SubdivideExtrude(MolaMesh=split_7.MolaMesh1, Height=number_slider_4, Cap=True, Iteration=1)

join_6 = MeshJoin(MolaMeshes=[split_7.MolaMesh2, extrude_6])

analyze_mesh_8 = AnalyzeMolaMesh(MolaMesh=join_6)  # -> VerticeCount, FaceCount
random_8 = Random(Range=Domain(0, 1), Number=analyze_mesh_8.FaceCount, Seed=2)
larger_8 = LargerThan(FirstNumber=random_8, SecondNumber=Slider(0.5, range=0..1))  # -> LargerThan, OrEqualTo
split_8 = MeshSplit(MolaMesh=join_6, BooleanList=larger_8.LargerThan)  # -> MolaMesh1, MolaMesh2
extrude_7 = SubdivideExtrude(MolaMesh=split_8.MolaMesh1, Height=number_slider_4, Cap=True, Iteration=1)

join_7 = MeshJoin(MolaMeshes=[split_8.MolaMesh2, extrude_7])

analyze_mesh_9 = AnalyzeMolaMesh(MolaMesh=join_7)  # -> VerticeCount, FaceCount
random_9 = Random(Range=Domain(0, 1), Number=analyze_mesh_9.FaceCount, Seed=2)
larger_9 = LargerThan(FirstNumber=random_9, SecondNumber=Slider(0.9, range=0..1))  # -> LargerThan, OrEqualTo
split_9 = MeshSplit(MolaMesh=join_7, BooleanList=larger_9.LargerThan)  # -> MolaMesh1, MolaMesh2
extrude_8 = SubdivideExtrude(MolaMesh=split_9.MolaMesh1, Height=number_slider_4, Cap=True, Iteration=1)

join_8 = MeshJoin(MolaMeshes=[extrude_8, split_9.MolaMesh2, split_5.MolaMesh2])
topology = UpdateTopology(MolaMesh=join_8)
grid_2 = SubdivideGrid(MolaMesh=topology, U=2, V=Slider(1, range=0..1), Iteration=1)
extrude_tapered = SubdivideExtrudeTapered(MolaMesh=grid_2, Height=Slider(0, range=0..100), Fraction=Slider(0.2, range=0..1), Cap=True, Iteration=1)
face_modulo = AnalyzeFaceModulo(MolaMesh=extrude_tapered, Modulo=5, N=4)
split_10 = MeshSplit(MolaMesh=extrude_tapered, BooleanList=face_modulo)  # -> MolaMesh1, MolaMesh2
color = ColorMesh(
    MolaMesh=split_10.MolaMesh1,
    Mode=0,
    SingleColor=ColourSwatch(SwatchColor=RGB(28, 35, 135)),
    ColorList=RGB(255, 255, 255),
    ValueList=0)
to_rhino = MolaToRhino(MolaMesh=split_10.MolaMesh2, WithColor=True)
to_rhino_2 = MolaToRhino(MolaMesh=color, WithColor=True)
