# Grasshopper definition 06_nDArray_to_mesh.gh (Grasshopper 1.0.7)
# plug-ins: HDMolaGH

brep = Brep(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)

number_slider = Slider(3, range=0..10)
c_script = CSharpScript(nX_input=number_slider, nY_input=number_slider, nZ_input=number_slider)  # -> out, A, nX, nY, nZ; inputs nX_input: Int32, nY_input: Int32, nZ_input: Int32
# ---------- c_script: C# ----------
    int[,,] array3D = new int[nX_input, nY_input, nZ_input];

    for (int d = 0; d < nX_input; d++)
    {
      for (int r = 0; r < nY_input; r++)
      {
        for (int c = 0; c < nZ_input; c++)
        {
          array3D[d, r, c] = (d + r + c) % 2; // Alternating 0 and 1
        }
      }
    }
    A = array3D;
    nX = array3D.GetLength(0);
    nY = array3D.GetLength(1);
    nZ = array3D.GetLength(2);
# ---------- end c_script ----------
array_to_molamesh = ArrayToMolaMesh(Array=c_script.A, NX=c_script.nX, NY=c_script.nY, NZ=c_script.nZ, Value=Slider(0, range=0..100))
color_mesh = ColorMesh(
    MolaMesh=array_to_molamesh,
    Mode=0,
    SingleColor=ColourSwatch(SwatchColor=RGB(237, 129, 247)),
    ColorList=RGB(255, 255, 255),
    ValueList=0)
mola_to_rhino = MolaToRhino(MolaMesh=color_mesh, WithColor=Toggle(True))

# ---- group: Fix Mesh to Boundingbox
deconstruct_brep = DeconstructBrep(Brep=brep)  # -> Faces, Edges, Vertices
panel = Panel("""0
4
1""")
list_item = ListItem(List=deconstruct_brep.Edges, Index=panel, Wrap=True)
entwine = Entwine(Branch00=c_script.nX, Branch01=c_script.nY, Branch02=c_script.nZ, FlattenInputs=True)  # -> flatten(Result)
list_item_2 = ListItem(List=deconstruct_brep.Vertices, Index=0, Wrap=True)
length = Length(Curve=list_item)
division = Division(A=length, B=entwine)
list_item_3 = ListItem(List=division, Index="2", Wrap=True)
list_item_4 = ListItem(List=division, Index="1", Wrap=True)
list_item_5 = ListItem(List=division, Index="0", Wrap=True)
scale_nu = ScaleNU(Geometry=mola_to_rhino, Plane=PlaneXY(0, 0, 0), ScaleX=list_item_5, ScaleY=list_item_4, ScaleZ=list_item_3)  # -> Geometry, Transform
move = Move(Geometry=scale_nu.Geometry, Motion=list_item_2)  # -> Geometry, Transform
