# Grasshopper definition 07_Grid_to_Mola.gh (Grasshopper 1.0.7)
# plug-ins: HDMolaGH

number_slider = Slider(3, range=0..10)
number_slider_2 = Slider(3, range=0..10)
brep = Brep(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)
neg = Negative(Value=Slider(0.1, range=0..1))

number_slider_3 = Slider(3, range=0..10)
c_script = CSharpScript(nX=number_slider_3, nY=number_slider, nZ=number_slider_2)  # -> out, A; inputs nX: Int32, nY: Int32, nZ: Int32
# ---------- c_script: C# ----------
    int[,,] array3D = new int[nX, nY, nZ];

    for (int d = 0; d < nX; d++)
    {
      for (int r = 0; r < nY; r++)
      {
        for (int c = 0; c < nZ; c++)
        {
          array3D[d, r, c] = (d + r + c) % 2; // Alternating 0 and 1
        }
      }
    }
    A = array3D;
# ---------- end c_script ----------
array_to_molamesh = ArrayToMolaMesh(Array=c_script.A, NX=number_slider_3, NY=number_slider, NZ=number_slider_2, Value=Slider(0, range=0..100))
color_mesh = ColorMesh(
    MolaMesh=array_to_molamesh,
    Mode=0,
    SingleColor=ColourSwatch(SwatchColor=RGB(237, 129, 247)),
    ColorList=RGB(255, 255, 255),
    ValueList=0)

offset = SubdivideOffset(MolaMesh=array_to_molamesh, Offset=neg, Iteration=1)

mola_to_rhino = MolaToRhino(MolaMesh=offset, WithColor=Toggle(True))

# ---- group: Fix Mesh to Boundingbox
deconstruct_brep = DeconstructBrep(Brep=brep)  # -> Faces, Edges, Vertices
panel = Panel("""0
4
1""")
list_item = ListItem(List=deconstruct_brep.Edges, Index=panel, Wrap=True)
entwine = Entwine(Branch00=number_slider_3, Branch01=number_slider, Branch02=number_slider_2, FlattenInputs=True)  # -> flatten(Result)
list_item_2 = ListItem(List=deconstruct_brep.Vertices, Index=0, Wrap=True)
length = Length(Curve=list_item)
division = Division(A=length, B=entwine)
list_item_3 = ListItem(List=division, Index="2", Wrap=True)
list_item_4 = ListItem(List=division, Index="1", Wrap=True)
list_item_5 = ListItem(List=division, Index="0", Wrap=True)
scale_nu = ScaleNU(Geometry=mola_to_rhino, Plane=PlaneXY(0, 0, 0), ScaleX=list_item_5, ScaleY=list_item_4, ScaleZ=list_item_3)  # -> Geometry, Transform
move = Move(Geometry=scale_nu.Geometry, Motion=list_item_2)  # -> Geometry, Transform
