# Grasshopper definition BlockDesignJ.gh (Grasshopper 1.0.7)
# plug-ins: HDMolaGH, Human

# ---- group: input
number_slider = Slider(278, range=0..1000)
number_slider_2 = Slider(88, range=0..100)
quad = MolaQuad(
    X1=0,
    Y1=0,
    Z1=0,
    X2=number_slider,
    Y2=0,
    Z2=0,
    X3=number_slider,
    Y3=number_slider_2,
    Z3=0,
    X4=0,
    Y4=number_slider_2,
    Z4=0)

# ----
number_slider_3 = Slider(6, range=0..10)
number_slider_4 = Slider(650, range=0..1000)
number_slider_5 = Slider(1300, range=0..10000)
quad_2 = MolaQuad(
    X1=0,
    Y1=0,
    Z1=0,
    X2=number_slider_5,
    Y2=0,
    Z2=0,
    X3=number_slider_5,
    Y3=number_slider_4,
    Z3=0,
    X4=0,
    Y4=number_slider_4,
    Z4=0)
number_slider_6 = Slider(0.4, range=0..1)
number_slider_7 = Slider(0.6, range=0..1)
relative = SubdivideRelative(
    MolaMesh=quad_2,
    StartDiriection=0,
    MinSplit1=number_slider_6,
    MaxSplit1=number_slider_6,
    MinSplit2=number_slider_7,
    MaxSplit2=number_slider_7,
    Iteration=Slider(5, range=0..10))

# ---- group: block design
number_slider_8 = Slider(0.6, range=0..1)
number_slider_9 = Slider(0.4, range=0..1)
relative_2 = SubdivideRelative(
    MolaMesh=quad,
    StartDiriection=0,
    MinSplit1=number_slider_9,
    MaxSplit1=number_slider_9,
    MinSplit2=number_slider_8,
    MaxSplit2=number_slider_8,
    Iteration=2)

# ----
offset = SubdivideOffset(MolaMesh=relative, Offset=Slider(-6, range=-10..-6), Iteration=1)

# ---- group: block design
number_slider_10 = Slider(2, range=0..10)
grid = SubdivideGrid(MolaMesh=relative_2, U=number_slider_10, V=number_slider_10, Iteration=1)

# ----
face_modulo = AnalyzeFaceModulo(MolaMesh=offset, Modulo=5, N=4)
split = MeshSplit(MolaMesh=offset, BooleanList=face_modulo)  # -> MolaMesh1, MolaMesh2

# ---- group: park
join = MeshJoin(MolaMeshes=split.MolaMesh1)
color = ColorMesh(MolaMesh=join, Mode=0, SingleColor=ColourSwatch(SwatchColor=RGB(8, 250, 0)), ColorList=RGB(255, 255, 255), ValueList=0)
to_rhino = MolaToRhino(MolaMesh=color, WithColor=True)

# ----
mesh = Mesh(to_rhino)
demesh = DeconstructMesh(Mesh=mesh)  # -> Vertices, Faces, Colours, Normals

# ---- group: block design
analyze_mesh = AnalyzeMolaMesh(MolaMesh=grid)  # -> VerticeCount, FaceCount
random = Random(Range=Domain(0, 1), Number=analyze_mesh.FaceCount, Seed=Slider(5, range=0..10))
larger = LargerThan(FirstNumber=random, SecondNumber=0.3)  # -> LargerThan, OrEqualTo
split_2 = MeshSplit(MolaMesh=grid, BooleanList=larger.OrEqualTo)  # -> MolaMesh1, MolaMesh2
grid_2 = SubdivideGrid(MolaMesh=split_2.MolaMesh1, U=2, V=1, Iteration=1)
join_2 = MeshJoin(MolaMeshes=[split_2.MolaMesh2, grid_2])

# ---- group: park
join_3 = MeshJoin(MolaMeshes=split.MolaMesh2)
color_2 = ColorMesh(MolaMesh=join_3, Mode=0, SingleColor=ColourSwatch(SwatchColor=RGB(0, 0, 0)), ColorList=RGB(255, 255, 255), ValueList=0)
to_rhino_2 = MolaToRhino(MolaMesh=color_2, WithColor=True)

# ----
deface = DeconstructFace(Face=demesh.Faces)  # -> CornerA, CornerB, CornerC, CornerD

# ---- group: further divide plots which are too long
face_proportion = AnalyzeFaceProportion(MolaMesh=join_2)
larger_2 = LargerThan(FirstNumber=face_proportion, SecondNumber=Slider(766, range=0..1000))  # -> LargerThan, OrEqualTo
number_slider_11 = Slider(15, range=0..20)
split_3 = MeshSplit(MolaMesh=join_2, BooleanList=larger_2.LargerThan)  # -> MolaMesh1, MolaMesh2
linear_split_border = SubdivideLinearSplitBorder(MolaMesh=split_3.MolaMesh1, BorderWidth1=number_slider_11, BorderWidth2=number_slider_11, SplitDirection=0, Iteration=1)
join_4 = MeshJoin(MolaMeshes=[split_3.MolaMesh2, linear_split_border])

# ----
item = ListItem(List=demesh.Vertices, Index=deface.CornerC, Wrap=True)
item_2 = ListItem(List=demesh.Vertices, Index=deface.CornerB, Wrap=True)
item_3 = ListItem(List=demesh.Vertices, Index=deface.CornerA, Wrap=True)
dist = Distance(PointA=item_3, PointB=item_2)
dist_2 = Distance(PointA=item, PointB=item_2)
panel = Panel(dist_2)
justified_text = JustifiedText3d(Text=dist_2, Size=1, HorizontalAlignment=1, VerticalAlginment=1, UseMeshes=False, Bake=False)

# ---- group: assign small plots to park
face_area = AnalyzeFaceArea(MolaMesh=join_4)
smaller = SmallerThan(FirstNumber=face_area, SecondNumber=Slider(400, range=0..400))  # -> SmallerThan, OrEqualTo
split_4 = MeshSplit(MolaMesh=join_4, BooleanList=smaller.OrEqualTo)  # -> MolaMesh1, MolaMesh2

# ---- group: road
number_slider_12 = Slider(-4, range=-10..5)
offset_2 = SubdivideOffset(MolaMesh=split_4.MolaMesh2, Offset=number_slider_12, Iteration=1)
face_modulo_2 = AnalyzeFaceModulo(MolaMesh=offset_2, Modulo=5, N=4)
split_5 = MeshSplit(MolaMesh=offset_2, BooleanList=face_modulo_2)  # -> MolaMesh1, MolaMesh2

offset_3 = SubdivideOffset(MolaMesh=split_4.MolaMesh1, Offset=number_slider_12, Iteration=1)
face_modulo_3 = AnalyzeFaceModulo(MolaMesh=offset_3, Modulo=5, N=4)
split_6 = MeshSplit(MolaMesh=offset_3, BooleanList=face_modulo_3)  # -> MolaMesh1, MolaMesh2

join_5 = MeshJoin(MolaMeshes=[split_5.MolaMesh2, split_6.MolaMesh2])
color_3 = ColorMesh(MolaMesh=join_5, Mode=0, SingleColor=ColourSwatch(SwatchColor=RGB(0, 0, 0)), ColorList=RGB(255, 255, 255), ValueList=0)
to_rhino_3 = MolaToRhino(MolaMesh=color_3, WithColor=True)

# ---- group: long plots for rectangular buildings, square plots for cylinder buildings
face_proportion_2 = AnalyzeFaceProportion(MolaMesh=split_5.MolaMesh1)
larger_3 = LargerThan(FirstNumber=face_proportion_2, SecondNumber=Slider(223, range=0..1000))  # -> LargerThan, OrEqualTo
split_7 = MeshSplit(MolaMesh=split_5.MolaMesh1, BooleanList=larger_3.LargerThan)  # -> MolaMesh1, MolaMesh2

# ---- group: make rectangular buildings
analyze_mesh_2 = AnalyzeMolaMesh(MolaMesh=split_7.MolaMesh1)  # -> VerticeCount, FaceCount
random_2 = Random(Range="10 to 50", Number=analyze_mesh_2.FaceCount, Seed=2)
repeat = RepeatData(Data=Toggle(True), Length=analyze_mesh_2.FaceCount)
extrude_values = SubdivideExtrudeValues(MolaMesh=split_7.MolaMesh1, HeightValues=random_2, Cap=repeat, Iteration=1)

# ---- group: cylinder buildings
explode = MeshExplode(MolaMesh=split_7.MolaMesh2)
face_location = AnalyzeFaceLocation(MolaMesh=explode)
face_perimeter = AnalyzeFaceEdgePerimeter(MolaMesh=explode)
pdecon = Deconstruct(Point=face_location)  # -> XComponent, YComponent, ZComponent
division = Division(A=face_perimeter, B=8)
circle = MolaCircle(X=pdecon.XComponent, Y=pdecon.YComponent, Z=pdecon.ZComponent, Radius=division, Segments=Slider(12, range=0..100))
lng = ListLength(List=explode)
random_3 = Random(Range="40 to 90", Number=lng, Seed=2)  # -> graft(Random)
extrude = SubdivideExtrude(MolaMesh=circle, Height=random_3, Cap=True, Iteration=1)
face_modulo_4 = AnalyzeFaceModulo(MolaMesh=extrude, Modulo=4, N=1)
split_8 = MeshSplit(MolaMesh=extrude, BooleanList=face_modulo_4)  # -> MolaMesh1, MolaMesh2
split_grid_abs = SubdivideSplitGridAbs(MolaMesh=split_8.MolaMesh1, USize=Slider(5, range=0..10), VSize=Slider(3, range=0..10), Iteration=1)
analyze_mesh_3 = AnalyzeMolaMesh(MolaMesh=split_grid_abs)  # -> VerticeCount, FaceCount
random_4 = Random(Range=Domain(0, 1), Number=analyze_mesh_3.FaceCount, Seed=2)
larger_4 = LargerThan(FirstNumber=random_4, SecondNumber=0.7)  # -> LargerThan, OrEqualTo
split_9 = MeshSplit(MolaMesh=split_grid_abs, BooleanList=larger_4.LargerThan)  # -> MolaMesh1, MolaMesh2
offset_face = SubdivideOffsetFace(MolaMesh=split_9.MolaMesh2, Offset=Slider(-6, range=-10..-3), CloseBorders=True, Iteration=1)
catmullclark = SubdivideCatmullClark(MolaMesh=offset_face, Iteration=1)  # -> flatten(MolaMesh)
extrude_tapered = SubdivideExtrudeTapered(MolaMesh=catmullclark, Height=0, Fraction=0.2, Cap=True, Iteration=1)
face_modulo_5 = AnalyzeFaceModulo(MolaMesh=extrude_tapered, Modulo=5, N=4)
split_10 = MeshSplit(MolaMesh=extrude_tapered, BooleanList=face_modulo_5)  # -> MolaMesh1, MolaMesh2
offset_face_2 = SubdivideOffsetFace(MolaMesh=split_10.MolaMesh2, Offset=Slider(-0.4, range=-1..0), CloseBorders=True, Iteration=1)

# ---- group: white facade
join_6 = MeshJoin(MolaMeshes=offset_face_2)
color_4 = ColorMesh(
    MolaMesh=join_6,
    Mode=0,
    SingleColor=ColourSwatch(SwatchColor=RGB(255, 255, 255)),
    ColorList=RGB(255, 255, 255),
    ValueList=0)
to_rhino_4 = MolaToRhino(MolaMesh=color_4, WithColor=True)

# ---- group: short buildings have pitched roof
face_modulo_6 = AnalyzeFaceModulo(MolaMesh=extrude_values, Modulo=5, N=4)
split_11 = MeshSplit(MolaMesh=extrude_values, BooleanList=face_modulo_6)  # -> MolaMesh1, MolaMesh2
panel_2 = Panel("""4
4
4
4""")
face_location_2 = AnalyzeFaceLocation(MolaMesh=split_11.MolaMesh1)
pdecon_2 = Deconstruct(Point=face_location_2)  # -> XComponent, YComponent, ZComponent
smaller_2 = SmallerThan(FirstNumber=pdecon_2.ZComponent, SecondNumber=15)  # -> SmallerThan, OrEqualTo
stack = StackData(Data=smaller_2.SmallerThan, Stack=panel_2)
split_12 = MeshSplit(MolaMesh=split_11.MolaMesh1, BooleanList=smaller_2.SmallerThan)  # -> MolaMesh1, MolaMesh2
split_13 = MeshSplit(MolaMesh=split_11.MolaMesh2, BooleanList=stack)  # -> MolaMesh1, MolaMesh2
split_roof = SubdivideSplitRoof(MolaMesh=split_12.MolaMesh1, Height=Slider(8, range=0..10), Iteration=1)
grid_3 = SubdivideGrid(MolaMesh=split_13.MolaMesh1, U=Slider(14, range=0..20), V=Slider(5, range=0..10), Iteration=1)
analyze_mesh_4 = AnalyzeMolaMesh(MolaMesh=grid_3)  # -> VerticeCount, FaceCount
random_5 = Random(Range=Domain(0, 1), Number=analyze_mesh_4.FaceCount, Seed=2)
larger_5 = LargerThan(FirstNumber=random_5, SecondNumber=Slider(0.15, range=0..1))  # -> LargerThan, OrEqualTo
split_14 = MeshSplit(MolaMesh=grid_3, BooleanList=larger_5.LargerThan)  # -> MolaMesh1, MolaMesh2

# ---- group: park
join_7 = MeshJoin(MolaMeshes=[split_12.MolaMesh2, split_7.MolaMesh2, split_6.MolaMesh1])
color_5 = ColorMesh(MolaMesh=join_7, Mode=0, SingleColor=ColourSwatch(SwatchColor=RGB(8, 250, 0)), ColorList=RGB(255, 255, 255), ValueList=0)
to_rhino_5 = MolaToRhino(MolaMesh=color_5, WithColor=True)

# ---- group: grey facade
join_8 = MeshJoin(MolaMeshes=[split_roof, split_14.MolaMesh1])
color_6 = ColorMesh(
    MolaMesh=join_8,
    Mode=0,
    SingleColor=ColourSwatch(SwatchColor=RGB(150, 150, 149)),
    ColorList=RGB(255, 255, 255),
    ValueList=0)
to_rhino_6 = MolaToRhino(MolaMesh=color_6, WithColor=True)

# ---- group: taller buildings have meta frames
number_slider_13 = Slider(3, range=0..10)
grid_4 = SubdivideGrid(MolaMesh=split_13.MolaMesh2, U=number_slider_13, V=number_slider_13, Iteration=1)
extrude_tapered_2 = SubdivideExtrudeTapered(MolaMesh=grid_4, Height=0, Fraction=0.15, Cap=True, Iteration=1)
face_modulo_7 = AnalyzeFaceModulo(MolaMesh=extrude_tapered_2, Modulo=5, N=4)
split_15 = MeshSplit(MolaMesh=extrude_tapered_2, BooleanList=face_modulo_7)  # -> MolaMesh1, MolaMesh2
offset_face_3 = SubdivideOffsetFace(MolaMesh=split_15.MolaMesh2, Offset=0.2, CloseBorders=True, Iteration=1)
analyze_mesh_5 = AnalyzeMolaMesh(MolaMesh=split_15.MolaMesh1)  # -> VerticeCount, FaceCount
random_6 = Random(Range=Domain(0, 1), Number=analyze_mesh_5.FaceCount, Seed=2)
larger_6 = LargerThan(FirstNumber=random_6, SecondNumber=Slider(0.6, range=0..1))  # -> LargerThan, OrEqualTo
split_16 = MeshSplit(MolaMesh=split_15.MolaMesh1, BooleanList=larger_6.LargerThan)  # -> MolaMesh1, MolaMesh2
extrude_2 = SubdivideExtrude(MolaMesh=split_16.MolaMesh1, Height=Slider(-9, range=-10..-9), Cap=True, Iteration=1)
join_9 = MeshJoin(MolaMeshes=[split_16.MolaMesh1, extrude_2])
split_grid_abs_2 = SubdivideSplitGridAbs(MolaMesh=join_9, USize=Slider(2, range=0..10), VSize=Slider(4, range=0..10), Iteration=1)
extrude_tapered_3 = SubdivideExtrudeTapered(MolaMesh=split_grid_abs_2, Height=0, Fraction=0.2, Cap=True, Iteration=1)
face_modulo_8 = AnalyzeFaceModulo(MolaMesh=extrude_tapered_3, Modulo=5, N=4)
split_17 = MeshSplit(MolaMesh=extrude_tapered_3, BooleanList=face_modulo_8)  # -> MolaMesh1, MolaMesh2

# ---- group: glass
join_10 = MeshJoin(MolaMeshes=[split_10.MolaMesh1, split_14.MolaMesh2, split_17.MolaMesh1])
color_7 = ColorMesh(
    MolaMesh=join_10,
    Mode=0,
    SingleColor=ColourSwatch(SwatchColor=RGB(32, 87, 145)),
    ColorList=RGB(255, 255, 255),
    ValueList=0)
to_rhino_7 = MolaToRhino(MolaMesh=color_7, WithColor=True)

# ---- group: metal facade
join_11 = MeshJoin(MolaMeshes=[split_17.MolaMesh2, offset_face_3])
color_8 = ColorMesh(
    MolaMesh=join_11,
    Mode=0,
    SingleColor=ColourSwatch(SwatchColor=RGB(212, 166, 0)),
    ColorList=RGB(255, 255, 255),
    ValueList=0)
to_rhino_8 = MolaToRhino(MolaMesh=color_8, WithColor=True)
