# Grasshopper definition BuildingC.gh (Grasshopper 1.0.7)
# plug-ins: HDMolaGH

number_slider = Slider(50, range=0..100)
quad = MolaQuad(X1=0, Y1=0, Z1=0, X2=number_slider, Y2=0, Z2=0, X3=number_slider, Y3=number_slider, Z3=0, X4=0, Y4=number_slider, Z4=0)
extrude_point_center = SubdivideExtrudeToPointCenter(MolaMesh=quad, Height=Slider(51, range=0..100), Iteration=1)
extrude_tapered = SubdivideExtrudeTapered(MolaMesh=extrude_point_center, Height=0, Fraction=Slider(0.3, range=0..1), Cap=False, Iteration=1)
split_frame = SubdivideSplitFrame(MolaMesh=extrude_point_center, Witdh=Slider(6, range=0..10), Iteration=1)
offset_face = SubdivideOffsetFace(MolaMesh=extrude_tapered, Offset=Slider(3, range=0..10), CloseBorders=True, Iteration=1)
to_rhino = MolaToRhino(MolaMesh=offset_face, WithColor=True)
