# Grasshopper definition BuildingD.gh (Grasshopper 1.0.7)
# plug-ins: HDMolaGH

number_slider = Slider(-50, range=-100..-50)
number_slider_2 = Slider(50, range=0..100)
quad = MolaQuad(
    X1=number_slider,
    Y1=number_slider,
    Z1=0,
    X2=number_slider_2,
    Y2=number_slider,
    Z2=0,
    X3=number_slider_2,
    Y3=number_slider_2,
    Z3=0,
    X4=number_slider,
    Y4=number_slider_2,
    Z4=0)
extrude_tapered = SubdivideExtrudeTapered(MolaMesh=quad, Height=Slider(48, range=0..100), Fraction=Slider(0.2, range=0..1), Cap=True, Iteration=1)
face_modulo = AnalyzeFaceModulo(MolaMesh=extrude_tapered, Modulo=5, N=4)
split = MeshSplit(MolaMesh=extrude_tapered, BooleanList=face_modulo)  # -> MolaMesh1, MolaMesh2
number_slider_3 = Slider(19, range=0..20)
extrude_tapered_2 = SubdivideExtrudeTapered(MolaMesh=split.MolaMesh1, Height=Slider(10, range=0..10), Fraction=Slider(0.3, range=0..1), Cap=True, Iteration=1)
face_modulo_2 = AnalyzeFaceModulo(MolaMesh=extrude_tapered_2, Modulo=5, N=4)
grid = SubdivideGrid(MolaMesh=split.MolaMesh2, U=number_slider_3, V=Slider(2, range=0..20), Iteration=1)
split_2 = MeshSplit(MolaMesh=extrude_tapered_2, BooleanList=face_modulo_2)  # -> MolaMesh1, MolaMesh2
grid_2 = SubdivideGrid(MolaMesh=split_2.MolaMesh2, U=number_slider_3, V=2, Iteration=1)
face_perimeter = AnalyzeFaceEdgePerimeter(MolaMesh=grid)
sort = SortList(Keys=face_perimeter)  # -> Keys, ValuesA
extrude_tapered_3 = SubdivideExtrudeTapered(MolaMesh=split_2.MolaMesh1, Height=Slider(56, range=0..100), Fraction=Slider(0.3, range=0..1), Cap=True, Iteration=1)
item = ListItem(List=sort.Keys, Index=Slider(-8, range=-10..-8), Wrap=True)
face_modulo_3 = AnalyzeFaceModulo(MolaMesh=extrude_tapered_3, Modulo=5, N=4)
larger = LargerThan(FirstNumber=face_perimeter, SecondNumber=item)  # -> LargerThan, OrEqualTo
split_3 = MeshSplit(MolaMesh=grid, BooleanList=larger.OrEqualTo)  # -> MolaMesh1, MolaMesh2
face_modulo_4 = AnalyzeFaceModulo(MolaMesh=split_3.MolaMesh2, Modulo=Slider(7, range=0..10), N=0)
split_4 = MeshSplit(MolaMesh=split_3.MolaMesh2, BooleanList=face_modulo_4)  # -> MolaMesh1, MolaMesh2
split_5 = MeshSplit(MolaMesh=extrude_tapered_3, BooleanList=face_modulo_3)  # -> MolaMesh1, MolaMesh2
extrude_tapered_4 = SubdivideExtrudeTapered(MolaMesh=split_5.MolaMesh1, Height=Slider(9, range=0..10), Fraction=Slider(0.1, range=0..1), Cap=True, Iteration=1)
grid_3 = SubdivideGrid(MolaMesh=split_5.MolaMesh2, U=number_slider_3, V=Slider(6, range=0..10), Iteration=1)
face_modulo_5 = AnalyzeFaceModulo(MolaMesh=extrude_tapered_4, Modulo=5, N=4)
extrudealong = SubdivideExtrudeAlongVec(MolaMesh=split_3.MolaMesh1, Direction=Vector(0, 0, 1), Height=Slider(200, range=0..200), Cap=True, Iteration=1)
grid_4 = SubdivideGrid(MolaMesh=extrudealong, U=Slider(1, range=0..1), V=Slider(7, range=0..10), Iteration=1)
extrude_tapered_5 = SubdivideExtrudeTapered(MolaMesh=grid_4, Height=0, Fraction=Slider(0.8, range=0..1), Cap=True, Iteration=1)
split_6 = MeshSplit(MolaMesh=extrude_tapered_4, BooleanList=face_modulo_5)  # -> MolaMesh1, MolaMesh2
grid_5 = SubdivideGrid(MolaMesh=split_6.MolaMesh2, U=number_slider_3, V=2, Iteration=1)
face_modulo_6 = AnalyzeFaceModulo(MolaMesh=extrude_tapered_5, Modulo=5, N=4)
extrude_tapered_6 = SubdivideExtrudeTapered(MolaMesh=split_6.MolaMesh1, Height=Slider(15, range=0..100), Fraction=0.5, Cap=True, Iteration=1)
split_7 = MeshSplit(MolaMesh=extrude_tapered_5, BooleanList=face_modulo_6)  # -> MolaMesh1, MolaMesh2
to_rhino = MolaToRhino(MolaMesh=split_7.MolaMesh2, WithColor=True)
face_modulo_7 = AnalyzeFaceModulo(MolaMesh=extrude_tapered_6, Modulo=5, N=4)

face_perimeter_2 = AnalyzeFaceEdgePerimeter(MolaMesh=grid_3)
sort_2 = SortList(Keys=face_perimeter_2)  # -> Keys, ValuesA
item_2 = ListItem(List=sort_2.Keys, Index=Slider(-8, range=-10..-8), Wrap=True)
larger_2 = LargerThan(FirstNumber=face_perimeter_2, SecondNumber=item_2)  # -> LargerThan, OrEqualTo
split_8 = MeshSplit(MolaMesh=grid_3, BooleanList=larger_2.OrEqualTo)  # -> MolaMesh1, MolaMesh2
to_rhino_2 = MolaToRhino(MolaMesh=split_8.MolaMesh2, WithColor=True)
extrudealong_2 = SubdivideExtrudeAlongVec(MolaMesh=split_8.MolaMesh1, Direction=Vector(0, 0, 1), Height=Slider(90, range=0..100), Cap=True, Iteration=1)
to_rhino_3 = MolaToRhino(MolaMesh=extrudealong_2, WithColor=True)

split_9 = MeshSplit(MolaMesh=extrude_tapered_6, BooleanList=face_modulo_7)  # -> MolaMesh1, MolaMesh2
grid_6 = SubdivideGrid(MolaMesh=split_9.MolaMesh2, U=number_slider_3, V=2, Iteration=1)
extrude_tapered_7 = SubdivideExtrudeTapered(MolaMesh=split_9.MolaMesh1, Height=Slider(100, range=0..100), Fraction=Slider(0.9, range=0..1), Cap=True, Iteration=1)
to_rhino_4 = MolaToRhino(MolaMesh=extrude_tapered_7, WithColor=True)
grid_7 = SubdivideGrid(MolaMesh=extrude_tapered_7, U=number_slider_3, V=2, Iteration=1)
extrude_point_center = SubdivideExtrudeToPointCenter(MolaMesh=split_8.MolaMesh2, Height=Slider(10, range=0..10), Iteration=1)
join = MeshJoin(MolaMeshes=[extrudealong_2, grid_2, grid_5, grid_6, grid_7, extrude_point_center, split_4.MolaMesh2, split_7.MolaMesh2])
catmullclark = SubdivideCatmullClark(MolaMesh=join, Iteration=Slider(1, range=0..10))
to_rhino_5 = MolaToRhino(MolaMesh=join, WithColor=False)
