# Grasshopper definition BuildingE.gh (Grasshopper 1.0.7)
# plug-ins: HDMolaGH

number_slider = Slider(-30, range=-100..-30)
number_slider_2 = Slider(30, range=0..100)
quad = MolaQuad(
    X1=number_slider,
    Y1=number_slider,
    Z1=0,
    X2=number_slider_2,
    Y2=number_slider,
    Z2=0,
    X3=number_slider_2,
    Y3=number_slider_2,
    Z3=0,
    X4=number_slider,
    Y4=number_slider_2,
    Z4=0)
extrude = SubdivideExtrude(MolaMesh=quad, Height=Slider(60, range=0..100), Cap=True, Iteration=1)
extrude_tapered = SubdivideExtrudeTapered(MolaMesh=extrude, Height=0, Fraction=Slider(0.042, range=0..1), Cap=False, Iteration=1)
offset_face = SubdivideOffsetFace(MolaMesh=extrude_tapered, Offset=Slider(5, range=0..10), CloseBorders=True, Iteration=1)
face_modulo = AnalyzeFaceModulo(MolaMesh=extrude, Modulo=5, N=Slider(4, range=0..10))
split = MeshSplit(MolaMesh=extrude, BooleanList=face_modulo)  # -> MolaMesh1, MolaMesh2
extrude_tapered_2 = SubdivideExtrudeTapered(MolaMesh=split.MolaMesh1, Height=Slider(-50, range=-100..-50), Fraction=Slider(1, range=0..1), Cap=True, Iteration=1)
grid = SubdivideGrid(MolaMesh=extrude_tapered_2, U=Slider(10, range=0..100), V=Slider(30, range=0..100), Iteration=1)
extrude_tapered_3 = SubdivideExtrudeTapered(MolaMesh=grid, Height=1, Fraction=Slider(0.2, range=0..1), Cap=True, Iteration=1)
face_modulo_2 = AnalyzeFaceModulo(MolaMesh=extrude_tapered_3, Modulo=5, N=4)
split_2 = MeshSplit(MolaMesh=extrude_tapered_3, BooleanList=face_modulo_2)  # -> MolaMesh1, MolaMesh2
join = MeshJoin(MolaMeshes=[offset_face, split.MolaMesh1, split_2.MolaMesh2])
analyze_mesh = AnalyzeMolaMesh(MolaMesh=split_2.MolaMesh1)  # -> VerticeCount, FaceCount
random = Random(Range=Domain(0, 1), Number=analyze_mesh.FaceCount, Seed=2)
larger = LargerThan(FirstNumber=random, SecondNumber=0.5)  # -> LargerThan, OrEqualTo
split_3 = MeshSplit(MolaMesh=split_2.MolaMesh1, BooleanList=larger.LargerThan)  # -> MolaMesh1, MolaMesh2
color = ColorMesh(
    MolaMesh=join,
    Mode=0,
    SingleColor=ColourSwatch(SwatchColor=RGB(207, 196, 196)),
    ColorList=RGB(255, 255, 255),
    ValueList=0)
color_2 = ColorMesh(
    MolaMesh=split_3.MolaMesh1,
    Mode=0,
    SingleColor=ColourSwatch(SwatchColor=RGB(18, 71, 163)),
    ColorList=RGB(255, 255, 255),
    ValueList=0)
color_3 = ColorMesh(
    MolaMesh=split_3.MolaMesh2,
    Mode=0,
    SingleColor=ColourSwatch(SwatchColor=RGB(255, 174, 0)),
    ColorList=RGB(255, 255, 255),
    ValueList=0)
to_rhino = MolaToRhino(MolaMesh=color, WithColor=True)
to_rhino_2 = MolaToRhino(MolaMesh=color_2, WithColor=True)
to_rhino_3 = MolaToRhino(MolaMesh=color_3, WithColor=True)
