# Grasshopper definition BuildingF.gh (Grasshopper 1.0.7)
# plug-ins: HDMolaGH

number_slider = Slider(10, range=0..10)
neg = Negative(Value=number_slider)
circle = MolaCircle(X=0, Y=0, Z=0, Radius=Slider(10, range=0..10), Segments=6)
quad = MolaQuad(
    X1=neg,
    Y1=neg,
    Z1=0,
    X2=number_slider,
    Y2=neg,
    Z2=0,
    X3=number_slider,
    Y3=number_slider,
    Z3=0,
    X4=neg,
    Y4=number_slider,
    Z4=0)
quad_2 = MolaQuad(X1=0, Y1=0, Z1=0, X2=1, Y2=0, Z2=0, X3=1, Y3=1, Z3=0, X4=0, Y4=1, Z4=0)
extrude = SubdivideExtrude(MolaMesh=circle, Height=Slider(6, range=0..10), Cap=True, Iteration=1)
c_script = CSharpScript(Reference=["C:\D\GitHub\HDMolaGH\install\HDMola.dll", "C:\D\GitHub\HDMolaGH\install\netstandard.dll"])  # -> Out, A
extrude_2 = SubdivideExtrude(MolaMesh=quad, Height=Slider(6, range=0..10), Cap=True, Iteration=1)
linear_split_border = SubdivideLinearSplitBorder(MolaMesh=quad_2, BorderWidth1=Slider(0.45, range=0..1), BorderWidth2=1, SplitDirection=0, Iteration=1)
grid = SubdivideGrid(MolaMesh=extrude, U=Slider(3, range=0..10), V=Slider(1, range=0..1), Iteration=1)
to_rhino = MolaToRhino(MolaMesh=linear_split_border, WithColor=True)
face_modulo = AnalyzeFaceModulo(MolaMesh=extrude_2, Modulo=5, N=4)
to_rhino_2 = MolaToRhino(MolaMesh=grid, WithColor=True)
split = MeshSplit(MolaMesh=extrude_2, BooleanList=face_modulo)  # -> MolaMesh1, MolaMesh2
extrude_tapered = SubdivideExtrudeTapered(MolaMesh=split.MolaMesh1, Height=1, Fraction=Slider(0.4, range=0..1), Cap=True, Iteration=1)
face_modulo_2 = AnalyzeFaceModulo(MolaMesh=extrude_tapered, Modulo=5, N=4)
split_2 = MeshSplit(MolaMesh=extrude_tapered, BooleanList=face_modulo_2)  # -> MolaMesh1, MolaMesh2
extrude_3 = SubdivideExtrude(MolaMesh=split_2.MolaMesh1, Height=Slider(6, range=0..10), Cap=True, Iteration=1)
face_modulo_3 = AnalyzeFaceModulo(MolaMesh=extrude_3, Modulo=5, N=4)
split_3 = MeshSplit(MolaMesh=extrude_3, BooleanList=face_modulo_3)  # -> MolaMesh1, MolaMesh2
extrude_tapered_2 = SubdivideExtrudeTapered(MolaMesh=split_3.MolaMesh1, Height=1, Fraction=0.5, Cap=True, Iteration=1)
face_modulo_4 = AnalyzeFaceModulo(MolaMesh=extrude_tapered_2, Modulo=5, N=4)
split_4 = MeshSplit(MolaMesh=extrude_tapered_2, BooleanList=face_modulo_4)  # -> MolaMesh1, MolaMesh2
extrude_4 = SubdivideExtrude(MolaMesh=split_4.MolaMesh1, Height=Slider(4, range=0..10), Cap=True, Iteration=1)
face_modulo_5 = AnalyzeFaceModulo(MolaMesh=extrude_4, Modulo=5, N=4)
split_5 = MeshSplit(MolaMesh=extrude_4, BooleanList=face_modulo_5)  # -> MolaMesh1, MolaMesh2
extrude_point_center = SubdivideExtrudeToPointCenter(MolaMesh=split_5.MolaMesh1, Height=Slider(5, range=0..10), Iteration=1)
join = MeshJoin(MolaMeshes=[split.MolaMesh2, split_2.MolaMesh2, split_3.MolaMesh2, split_4.MolaMesh2, split_5.MolaMesh2, extrude_point_center])
catmullclark = SubdivideCatmullClark(MolaMesh=join, Iteration=1)
to_rhino_3 = MolaToRhino(MolaMesh=extrude_point_center, WithColor=True)
to_rhino_4 = MolaToRhino(MolaMesh=join, WithColor=True)
