# Grasshopper definition BuildingI.gh (Grasshopper 1.0.7)
# plug-ins: HDMolaGH

circle = MolaCircle(X=0, Y=0, Z=0, Radius=Slider(50, range=0..100), Segments=Slider(18, range=0..100))
repeat = RepeatData(Data=Toggle(True), Length=Slider(4, range=0..10))
split = MeshSplit(MolaMesh=circle, BooleanList=repeat)  # -> MolaMesh1, MolaMesh2
grid = SubdivideGrid(MolaMesh=split.MolaMesh2, U=Slider(4, range=0..10), V=Slider(1, range=0..1), Iteration=1)
face_area = AnalyzeFaceArea(MolaMesh=grid)
larger = LargerThan(FirstNumber=face_area, SecondNumber=150)  # -> LargerThan, OrEqualTo
sort = SortList(Keys=face_area)  # -> Keys, ValuesA
split_2 = MeshSplit(MolaMesh=grid, BooleanList=larger.LargerThan)  # -> MolaMesh1, MolaMesh2
extrude = SubdivideExtrude(MolaMesh=split_2.MolaMesh1, Height=Slider(5, range=0..10), Cap=True, Iteration=1)
face_area_2 = AnalyzeFaceArea(MolaMesh=split_2.MolaMesh2)
larger_2 = LargerThan(FirstNumber=face_area_2, SecondNumber=90)  # -> LargerThan, OrEqualTo
split_3 = MeshSplit(MolaMesh=split_2.MolaMesh2, BooleanList=larger_2.LargerThan)  # -> MolaMesh1, MolaMesh2
panel = Panel(sort.Keys)
extrude_2 = SubdivideExtrude(MolaMesh=split_3.MolaMesh1, Height=Slider(13, range=0..20), Cap=True, Iteration=1)
face_area_3 = AnalyzeFaceArea(MolaMesh=split_3.MolaMesh2)
larger_3 = LargerThan(FirstNumber=face_area_3, SecondNumber=50)  # -> LargerThan, OrEqualTo
split_4 = MeshSplit(MolaMesh=split_3.MolaMesh2, BooleanList=larger_3.LargerThan)  # -> MolaMesh1, MolaMesh2
extrude_3 = SubdivideExtrude(MolaMesh=split_4.MolaMesh1, Height=Slider(22, range=0..30), Cap=True, Iteration=1)
join = MeshJoin(MolaMeshes=[extrude_3, extrude_2, extrude])
face_normal = AnalyzeFaceNormal(MolaMesh=join)
topology = UpdateTopology(MolaMesh=join)
pdecon = Deconstruct(Point=face_normal)  # -> XComponent, YComponent, ZComponent
equals = Equality(FirstNumber=pdecon.ZComponent, SecondNumber=0)  # -> Equality, Inequality
split_5 = MeshSplit(MolaMesh=join, BooleanList=equals.Equality)  # -> MolaMesh1, MolaMesh2
number_slider = Slider(3, range=0..10)
grid_2 = SubdivideGrid(MolaMesh=split_5.MolaMesh2, U=number_slider, V=number_slider, Iteration=1)
analyze_mesh = AnalyzeMolaMesh(MolaMesh=grid_2)  # -> VerticeCount, FaceCount
random = Random(Range=Domain(0, 1), Number=analyze_mesh.FaceCount, Seed=Slider(5, range=0..10))
larger_4 = LargerThan(FirstNumber=random, SecondNumber=Slider(0.8, range=0..1))  # -> LargerThan, OrEqualTo
split_6 = MeshSplit(MolaMesh=grid_2, BooleanList=larger_4.LargerThan)  # -> MolaMesh1, MolaMesh2
analyze_mesh_2 = AnalyzeMolaMesh(MolaMesh=split_6.MolaMesh1)  # -> VerticeCount, FaceCount
random_2 = Random(Range="10 to 50", Number=analyze_mesh_2.FaceCount, Seed=2)
repeat_2 = RepeatData(Data=Toggle(True), Length=analyze_mesh_2.FaceCount)
extrude_values = SubdivideExtrudeValues(MolaMesh=split_6.MolaMesh1, HeightValues=random_2, Cap=repeat_2, Iteration=1)
join_2 = MeshJoin(MolaMeshes=[split_5.MolaMesh1, split_6.MolaMesh2, extrude_values])
topology_2 = UpdateTopology(MolaMesh=join_2)
face_normal_2 = AnalyzeFaceNormal(MolaMesh=topology_2)
to_rhino = MolaToRhino(MolaMesh=join_2, WithColor=True)
pdecon_2 = Deconstruct(Point=face_normal_2)  # -> XComponent, YComponent, ZComponent
equals_2 = Equality(FirstNumber=pdecon_2.ZComponent, SecondNumber=1)  # -> Equality, Inequality
split_7 = MeshSplit(MolaMesh=join_2, BooleanList=equals_2.Equality)  # -> MolaMesh1, MolaMesh2
split_grid_abs = SubdivideSplitGridAbs(MolaMesh=split_7.MolaMesh2, USize=1, VSize=1, Iteration=1)
color = ColorMesh(
    MolaMesh=split_7.MolaMesh1,
    Mode=0,
    SingleColor=ColourSwatch(SwatchColor=RGB(70, 186, 20)),
    ColorList=RGB(255, 255, 255),
    ValueList=0)
extrude_tapered = SubdivideExtrudeTapered(MolaMesh=split_grid_abs, Height=0, Fraction=0.2, Cap=True, Iteration=1)
to_rhino_2 = MolaToRhino(MolaMesh=color, WithColor=True)
face_modulo = AnalyzeFaceModulo(MolaMesh=extrude_tapered, Modulo=5, N=4)
split_8 = MeshSplit(MolaMesh=extrude_tapered, BooleanList=face_modulo)  # -> MolaMesh1, MolaMesh2
to_rhino_3 = MolaToRhino(MolaMesh=split_8.MolaMesh2, WithColor=True)
analyze_mesh_3 = AnalyzeMolaMesh(MolaMesh=split_8.MolaMesh1)  # -> VerticeCount, FaceCount
random_3 = Random(Range=Domain(0, 1), Number=analyze_mesh_3.FaceCount, Seed=2)
larger_5 = LargerThan(FirstNumber=random_3, SecondNumber=Slider(0.1, range=0..1))  # -> LargerThan, OrEqualTo
split_9 = MeshSplit(MolaMesh=split_8.MolaMesh1, BooleanList=larger_5.LargerThan)  # -> MolaMesh1, MolaMesh2
color_2 = ColorMesh(
    MolaMesh=split_9.MolaMesh1,
    Mode=0,
    SingleColor=ColourSwatch(SwatchColor=RGB(42, 46, 102)),
    ColorList=RGB(255, 255, 255),
    ValueList=0)
to_rhino_4 = MolaToRhino(MolaMesh=color_2, WithColor=True)
color_3 = ColorMesh(
    MolaMesh=split_9.MolaMesh2,
    Mode=0,
    SingleColor=ColourSwatch(SwatchColor=RGB(222, 142, 4)),
    ColorList=RGB(255, 255, 255),
    ValueList=0)
to_rhino_5 = MolaToRhino(MolaMesh=color_3, WithColor=True)
