# Grasshopper definition City.gh (Grasshopper 1.0.7)
# plug-ins: HDMolaGH, Human

number_slider = Slider(650, range=0..1000)
number_slider_2 = Slider(1300, range=0..10000)
quad = MolaQuad(
    X1=0,
    Y1=0,
    Z1=0,
    X2=number_slider_2,
    Y2=0,
    Z2=0,
    X3=number_slider_2,
    Y3=number_slider,
    Z3=0,
    X4=0,
    Y4=number_slider,
    Z4=0)
number_slider_3 = Slider(0.4, range=0..1)
number_slider_4 = Slider(0.6, range=0..1)
relative = SubdivideRelative(
    MolaMesh=quad,
    StartDiriection=0,
    MinSplit1=number_slider_3,
    MaxSplit1=number_slider_3,
    MinSplit2=number_slider_4,
    MaxSplit2=number_slider_4,
    Iteration=Slider(5, range=0..10))
offset = SubdivideOffset(MolaMesh=relative, Offset=Slider(-6, range=-10..-5), Iteration=1)
face_modulo = AnalyzeFaceModulo(MolaMesh=offset, Modulo=5, N=4)
split = MeshSplit(MolaMesh=offset, BooleanList=face_modulo)  # -> MolaMesh1, MolaMesh2
panel = Panel("""park
A1
B1
C1
D1
E1
F1
G1
H1
I1
J1
K1
L1
M1
N1
O1
A2
B2
C2
D2
E2
F2
G2
Park
H2
I2
J2
K2
L2
M2
N2
O2""")
toggle = BooleanToggle(False)

# ---- group: park
join = MeshJoin(MolaMeshes=split.MolaMesh1)
color = ColorMesh(MolaMesh=join, Mode=0, SingleColor=ColourSwatch(SwatchColor=RGB(25, 143, 21)), ColorList=RGB(255, 255, 255), ValueList=0)
to_rhino = MolaToRhino(MolaMesh=color, WithColor=toggle)

# ----
face_location = AnalyzeFaceLocation(MolaMesh=join)
mesh = Mesh(to_rhino)
demesh = DeconstructMesh(Mesh=mesh)  # -> Vertices, Faces, Colours, Normals
pt = Point(face_location)

# ---- group: park
join_2 = MeshJoin(MolaMeshes=split.MolaMesh2)
color_2 = ColorMesh(MolaMesh=join_2, Mode=0, SingleColor=ColourSwatch(SwatchColor=RGB(0, 0, 0)), ColorList=RGB(255, 255, 255), ValueList=0)
to_rhino_2 = MolaToRhino(MolaMesh=color_2, WithColor=toggle)

# ----
deface = DeconstructFace(Face=demesh.Faces)  # -> CornerA, CornerB, CornerC, CornerD
justified_text = JustifiedText3d(
    Location=pt,
    Text=panel,
    Size=Slider(15, range=0..100),
    Color=ColourSwatch(SwatchColor=RGB(255, 254, 254)),
    HorizontalAlignment=1,
    VerticalAlginment=1,
    UseMeshes=False,
    Bake=False)
item = ListItem(List=demesh.Vertices, Index=deface.CornerC, Wrap=True)
item_2 = ListItem(List=demesh.Vertices, Index=deface.CornerB, Wrap=True)
item_3 = ListItem(List=demesh.Vertices, Index=deface.CornerA, Wrap=True)
dist = Distance(PointA=item, PointB=item_2)
dist_2 = Distance(PointA=item_3, PointB=item_2)
ln = Line(StartPoint=item_2, EndPoint=item)
ln_2 = Line(StartPoint=item_3, EndPoint=item_2)
round = Round(Number=dist)  # -> Nearest, Floor, Ceiling
round_2 = Round(Number=dist_2)  # -> Nearest, Floor, Ceiling
eval = EvaluateCurve(Curve=ln, Parameter=0.5)  # -> Point, Tangent, Angle
vec2pt = Vector2Pt(PointA=eval.Point, PointB=face_location, Unitize=False)  # -> unitize(Vector), Length
eval_2 = EvaluateCurve(Curve=ln_2, Parameter=0.5)  # -> Point, Tangent, Angle
vec2pt_2 = Vector2Pt(PointA=eval_2.Point, PointB=face_location, Unitize=False)  # -> unitize(Vector), Length
multiplication = Multiplication(A=vec2pt.Vector, B=10)
number_slider_5 = Slider(12, range=0..100)
move = Move(Geometry=eval.Point, Motion=multiplication)  # -> Geometry, Transform
multiplication_2 = Multiplication(A=vec2pt_2.Vector, B=20)
move_2 = Move(Geometry=eval_2.Point, Motion=multiplication_2)  # -> Geometry, Transform
justified_text_2 = JustifiedText3d(
    Location=move_2.Geometry,
    Text=round_2.Nearest,
    Size=number_slider_5,
    HorizontalAlignment=1,
    VerticalAlginment=1,
    UseMeshes=False,
    Bake=False)
justified_text_3 = JustifiedText3d(
    Location=move.Geometry,
    Text=round.Nearest,
    Size=number_slider_5,
    HorizontalAlignment=1,
    VerticalAlginment=1,
    UseMeshes=False,
    Bake=False)
