# Grasshopper definition CityExample.gh (Grasshopper 1.0.7)
# plug-ins: HDMolaGH

number_slider = Slider(300, range=0..1000)
number_slider_2 = Slider(150, range=0..1000)
quad = MolaQuad(
    X1=0,
    Y1=0,
    Z1=0,
    X2=number_slider_2,
    Y2=0,
    Z2=0,
    X3=number_slider_2,
    Y3=number_slider,
    Z3=0,
    X4=0,
    Y4=number_slider,
    Z4=0)
number_slider_3 = Slider(0.6, range=0..1)
number_slider_4 = Slider(0.4, range=0..1)
relative = SubdivideRelative(
    MolaMesh=quad,
    StartDiriection=0,
    MinSplit1=number_slider_4,
    MaxSplit1=number_slider_4,
    MinSplit2=number_slider_3,
    MaxSplit2=number_slider_3,
    Iteration=Slider(5, range=0..10))
offset = SubdivideOffset(MolaMesh=relative, Offset=Slider(-3, range=-10..10), Iteration=1)
face_modulo = AnalyzeFaceModulo(MolaMesh=offset, Modulo=Slider(5, range=0..10), N=Slider(4, range=0..10))
split = MeshSplit(MolaMesh=offset, BooleanList=face_modulo)  # -> MolaMesh1, MolaMesh2
analyze_mesh = AnalyzeMolaMesh(MolaMesh=split.MolaMesh1)  # -> VerticeCount, FaceCount
single_color = SingleColorMesh(MolaMesh=split.MolaMesh2, SingleColor=ColourSwatch(SwatchColor=RGB(59, 58, 37)))
random = Random(Range="10 to 100", Number=analyze_mesh.FaceCount, Seed=2)
panel = Panel(random)

# ---- group: Street
to_rhino = MolaToRhino(MolaMesh=single_color, WithColor=True)

# ----
extrude = SubdivideExtrude(MolaMesh=split.MolaMesh1, Height=random, Cap=True, Iteration=1)
to_rhino_2 = MolaToRhino(MolaMesh=extrude, WithColor=False)
