# Grasshopper definition ColorTemplate.gh (Grasshopper 1.0.7)
# plug-ins: HDMolaGH

number_slider = Slider(20, range=0..100)
number_slider_2 = Slider(20, range=0..100)
number_slider_3 = Slider(20, range=0..100)
pt = Point()
circle = MolaCircle(X=0, Y=0, Z=0, Radius=Slider(15, range=0..100), Segments=6)
face_modulo = AnalyzeFaceModulo(MolaMesh=circle, Modulo=6, N=0)
split = MeshSplit(MolaMesh=circle, BooleanList=face_modulo)  # -> MolaMesh1, MolaMesh2
extrude = SubdivideExtrude(MolaMesh=split.MolaMesh1, Height=Slider(50, range=0..100), Cap=True, Iteration=1)
face_area = AnalyzeFaceArea(MolaMesh=extrude)
larger = LargerThan(FirstNumber=face_area, SecondNumber=300)  # -> LargerThan, OrEqualTo
split_2 = MeshSplit(MolaMesh=extrude, BooleanList=larger.LargerThan)  # -> MolaMesh1, MolaMesh2
relative = SubdivideRelative(
    MolaMesh=split_2.MolaMesh1,
    StartDiriection=1,
    MinSplit1=Slider(0.4, range=0..1),
    MaxSplit1=Slider(0.8, range=0..1),
    MinSplit2=Slider(0.1, range=0..1),
    MaxSplit2=Slider(0.5, range=0..1),
    Iteration=1)
number_slider_4 = Slider(0.6, range=0..1)
number_slider_5 = Slider(0.4, range=0..1)
relative_2 = SubdivideRelative(
    MolaMesh=relative,
    StartDiriection=0,
    MinSplit1=number_slider_5,
    MaxSplit1=number_slider_5,
    MinSplit2=number_slider_4,
    MaxSplit2=number_slider_4,
    Iteration=1)
neg = Negative(Value=Slider(2, range=0..10))
offset = SubdivideOffset(MolaMesh=relative_2, Offset=neg, Iteration=1)
face_modulo_2 = AnalyzeFaceModulo(MolaMesh=offset, Modulo=5, N=4)
split_3 = MeshSplit(MolaMesh=offset, BooleanList=face_modulo_2)  # -> MolaMesh1, MolaMesh2
extrude_2 = SubdivideExtrude(MolaMesh=split_3.MolaMesh2, Height=Slider(4, range=0..10), Cap=True, Iteration=1)
neg_2 = Negative(Value=Slider(0.2, range=0..1))
split_grid_abs = SubdivideSplitGridAbs(MolaMesh=extrude_2, USize=1, VSize=1, Iteration=1)
extrude_tapered = SubdivideExtrudeTapered(MolaMesh=split_grid_abs, Height=neg_2, Fraction=Slider(0.2, range=0..1), Cap=True, Iteration=1)
face_modulo_3 = AnalyzeFaceModulo(MolaMesh=extrude_tapered, Modulo=5, N=4)
split_4 = MeshSplit(MolaMesh=extrude_tapered, BooleanList=face_modulo_3)  # -> MolaMesh1, MolaMesh2
color = ColorMesh(
    MolaMesh=split_4.MolaMesh2,
    Mode=0,
    SingleColor=ColourSwatch(SwatchColor=RGB(255, 153, 153)),
    ColorList=RGB(255, 255, 255),
    ValueList=0)
to_rhino = MolaToRhino(MolaMesh=color, WithColor=Toggle(True))
color_2 = ColorMesh(
    MolaMesh=split_4.MolaMesh1,
    Mode=0,
    SingleColor=ColourSwatch(SwatchColor=RGB(0, 0, 0)),
    ColorList=RGB(255, 255, 255),
    ValueList=0)
to_rhino_2 = MolaToRhino(MolaMesh=color_2, WithColor=Toggle(True))
