# Grasshopper definition VoxelExamplesUpdate.gh (Grasshopper 1.0.7)
# plug-ins: HDMolaGH

number_slider = Slider(30, range=0..100)
number_slider_2 = Slider(30, range=0..100)
number_slider_3 = Slider(30, range=0..100)
number_slider_4 = Slider(30, range=0..100)
number_slider_5 = Slider(30, range=0..100)
division = Division(A=number_slider, B=2)
division_2 = Division(A=number_slider_2, B=2)
division_3 = Division(A=number_slider_3, B=2)
gridintersection = CSharpScript(
    nx=number_slider,
    ny=number_slider,
    nz=number_slider,
    x=division,
    y=division,
    z=division,
    radius=Slider(10, range=0..100),
    ratio=Slider(0.5, range=0..1),
    Reference=["C:\D\GitHub\HDMolaGH\install\HDMola.dll", "C:\D\GitHub\HDMolaGH\install\netstandard.dll"])  # -> out, A; inputs nx: Int32, ny: Int32, nz: Int32, x: Double, y: Double, z: Double, radius: Double, ratio: Double
# ---------- gridintersection: C# usings ----------
using Mola;
# ---------- gridintersection: C# ----------
    // sphere grid
    MolaGrid<bool> gridSphere = new MolaGrid<bool>(nx, ny, nz);
    float radiusSquare = Mathf.Pow((float) radius, 2);
    for (int i = 0; i < gridSphere.Count; i++)
    {
      float dx = Mathf.Pow(gridSphere.getX(i) - (float) x, 2);
      float dy = Mathf.Pow(gridSphere.getY(i) - (float) y, 2);
      float dz = Mathf.Pow(gridSphere.getZ(i) - (float) z, 2);

      float dSquare = dx + dy + dz;
      if (dSquare <= radiusSquare)
      {
        gridSphere[i] = true;
      }
    }

    // random grid
    MolaGrid<bool> gridRandom = new MolaGrid<bool>(nx, ny, nz);
    var rand = new Random();
    for (int i = 0; i < gridRandom.Count; i++)
    {
      gridRandom[i] = rand.NextDouble() > (float) ratio;
    }
    
    // intersection
    MolaGrid<bool> gridIntersection = new MolaGrid<bool>(nx, ny, nz);
    for (int i = 0; i < gridIntersection.Count; i++)
    {
      gridIntersection[i] = gridSphere[i] && gridRandom[i];
    }


    MolaMesh mesh = UtilsGrid.VoxelMesh(gridIntersection);
    A = mesh;
# ---------- end gridintersection ----------
gridintersection_2 = CSharpScript(
    nx=number_slider_2,
    ny=number_slider_2,
    nz=number_slider_2,
    x=division_2,
    y=division_2,
    z=division_2,
    radius=Slider(10, range=0..100),
    ratio=Slider(0.5, range=0..1),
    Reference=["C:\D\GitHub\HDMolaGH\install\HDMola.dll", "C:\D\GitHub\HDMolaGH\install\netstandard.dll"])  # -> out, A; inputs nx: Int32, ny: Int32, nz: Int32, x: Double, y: Double, z: Double, radius: Double, ratio: Double; same code as gridintersection
randomgrid = CSharpScript(
    nx=number_slider_3,
    ny=number_slider_3,
    nz=number_slider_3,
    x=division_3,
    y=division_3,
    z=division_3,
    radius=Slider(10, range=0..100),
    Reference=["C:\D\GitHub\HDMolaGH\install\HDMola.dll", "C:\D\GitHub\HDMolaGH\install\netstandard.dll"])  # -> out, A; inputs nx: Int32, ny: Int32, nz: Int32, x: Double, y: Double, z: Double, radius: Double
# ---------- randomgrid: C# ----------
    MolaGrid<bool> grid = new MolaGrid<bool>(nx, ny, nz);
    var rand = new Random();
    float radiusSquare = Mathf.Pow((float) radius, 2);
    for (int i = 0; i < grid.Count; i++)
    {
      float dx = Mathf.Pow(grid.getX(i) - (float)x, 2);
      float dy = Mathf.Pow(grid.getY(i) - (float)y, 2);
      float dz = Mathf.Pow(grid.getZ(i) - (float)z, 2);

      float dSquare = dx + dy + dz;
      if (dSquare <= radiusSquare)
      {
        grid[i] = true;
      }
    }
    MolaMesh mesh = UtilsGrid.VoxelMesh(grid);
    A = mesh;
# ---------- end randomgrid ----------
randomgrid_2 = CSharpScript(
    nx=number_slider_4,
    ny=number_slider_4,
    nz=number_slider_4,
    ratio=Slider(0.6, range=0..1),
    Reference=["C:\D\GitHub\HDMolaGH\install\HDMola.dll", "C:\D\GitHub\HDMolaGH\install\netstandard.dll"])  # -> out, A; inputs nx: Int32, ny: Int32, nz: Int32, ratio: Double
# ---------- randomgrid_2: C# ----------
    MolaGrid<bool> grid = new MolaGrid<bool>(nx, ny, nz);
    var rand = new Random();
    for (int i = 0; i < grid.Count; i++)
    {
      grid[i] = rand.NextDouble() > (float) ratio;
    }
    MolaMesh mesh = UtilsGrid.VoxelMesh(grid);
    A = mesh;
# ---------- end randomgrid_2 ----------
wall = CSharpScript(
    nx=number_slider_5,
    ny=number_slider_5,
    nz=number_slider_5,
    x=Slider(6, range=0..30),
    Reference=["C:\D\GitHub\HDMolaGH\install\HDMola.dll", "C:\D\GitHub\HDMolaGH\install\netstandard.dll"])  # -> out, A; inputs nx: Int32, ny: Int32, nz: Int32, x: Int32
# ---------- wall: C# ----------
    MolaGrid<bool> grid = new MolaGrid<bool>(nx, ny, nz);
    for (int i = 0; i < grid.Count; i++)
    {
      if (grid.getX(i) == x)
      {
        grid[i] = true;
      }
    }
    MolaMesh mesh = UtilsGrid.VoxelMesh(grid);
    A = mesh;
# ---------- end wall ----------
face_normal = AnalyzeFaceNormal(MolaMesh=gridintersection.A)
pdecon = Deconstruct(Point=face_normal)  # -> XComponent, YComponent, ZComponent
equals = Equality(FirstNumber=pdecon.ZComponent, SecondNumber=1)  # -> Equality, Inequality
split = MeshSplit(MolaMesh=gridintersection.A, BooleanList=equals.Equality)  # -> MolaMesh1, MolaMesh2
face_normal_2 = AnalyzeFaceNormal(MolaMesh=split.MolaMesh2)
pdecon_2 = Deconstruct(Point=face_normal_2)  # -> XComponent, YComponent, ZComponent

split_roof = SubdivideSplitRoof(MolaMesh=split.MolaMesh1, Height=Slider(0.5, range=0..1), Iteration=1)
color = ColorMesh(
    MolaMesh=split_roof,
    Mode=0,
    SingleColor=ColourSwatch(SwatchColor=RGB(222, 0, 0)),
    ColorList=RGB(255, 255, 255),
    ValueList=0)
to_rhino = MolaToRhino(MolaMesh=color, WithColor=True)

equals_2 = Equality(FirstNumber=pdecon_2.ZComponent, SecondNumber=-1)  # -> Equality, Inequality
split_2 = MeshSplit(MolaMesh=split.MolaMesh2, BooleanList=equals_2.Equality)  # -> MolaMesh1, MolaMesh2
analyze_mesh = AnalyzeMolaMesh(MolaMesh=split_2.MolaMesh2)  # -> VerticeCount, FaceCount

color_2 = ColorMesh(
    MolaMesh=split_2.MolaMesh1,
    Mode=0,
    SingleColor=ColourSwatch(SwatchColor=RGB(23, 0, 0)),
    ColorList=RGB(255, 255, 255),
    ValueList=0)
to_rhino_2 = MolaToRhino(MolaMesh=color_2, WithColor=True)

random = Random(Range=Domain(0, 1), Number=analyze_mesh.FaceCount, Seed=2)
larger = LargerThan(FirstNumber=random, SecondNumber=0.5)  # -> LargerThan, OrEqualTo
split_3 = MeshSplit(MolaMesh=split_2.MolaMesh2, BooleanList=larger.LargerThan)  # -> MolaMesh1, MolaMesh2
extrude_tapered = SubdivideExtrudeTapered(MolaMesh=split_3.MolaMesh2, Height=0, Fraction=0.3, Cap=True, Iteration=1)
face_modulo = AnalyzeFaceModulo(MolaMesh=extrude_tapered, Modulo=5, N=4)
split_4 = MeshSplit(MolaMesh=extrude_tapered, BooleanList=face_modulo)  # -> MolaMesh1, MolaMesh2

color_3 = ColorMesh(
    MolaMesh=split_4.MolaMesh1,
    Mode=0,
    SingleColor=ColourSwatch(SwatchColor=RGB(12, 52, 232)),
    ColorList=RGB(255, 255, 255),
    ValueList=0)
to_rhino_3 = MolaToRhino(MolaMesh=color_3, WithColor=True)

join = MeshJoin(MolaMeshes=[split_3.MolaMesh1, split_4.MolaMesh2])
to_rhino_4 = MolaToRhino(MolaMesh=join, WithColor=True)
