# Grasshopper definition VoxelResolutionExample.gh (Grasshopper 1.0.7)
# plug-ins: HDMolaGH

number_slider = Slider(66, range=0..100)
c_script = CSharpScript(
    nx=number_slider,
    ny=number_slider,
    nz=number_slider,
    Reference=["/Users/yang/GitHub/20231205_MolaGH/install/netstandard.dll", "/Users/yang/GitHub/20231205_MolaGH/install/HDMola.dll"])  # -> out, A; inputs nx: Int32, ny: Int32, nz: Int32
# ---------- c_script: C# usings ----------
using Mola;
# ---------- c_script: C# ----------
MolaGrid<bool> grid = new MolaGrid<bool>(nx, ny, nz);

float overallSize=1;
float scale=overallSize/nx;

for(int i=0; i< grid.Count; i++)
{

    int x = grid.getX(i);
    int y = grid.getY(i);
    int z = grid.getZ(i);


    float posX=x*scale;
    float posY=y*scale;
    float posZ=z*scale;


    float radius = 0.3f;

    float centerX = overallSize * 0.5f;
    float centerY = overallSize * 0.5f;
    float centerZ = overallSize * 0.5f;

    float distX=posX-centerX;
    float distY=posY-centerY;
    float distZ=posZ-centerZ;

    if (Math.Pow(distX, 2) +Math.Pow(distY, 2)+Math.Pow((distZ), 2) < Math.Pow(radius, 2))
        {
        grid[i] = true;
        }

}

MolaMesh mesh = UtilsGrid.VoxelMesh(grid);
mesh.Scale(scale,scale,scale);
A = mesh;
# ---------- end c_script ----------
to_rhino = MolaToRhino(MolaMesh=c_script.A, WithColor=True)
