# Grasshopper definition extrudevalue.gh (Grasshopper 1.0.7)
# plug-ins: HDMolaGH

box = MolaBox(X1=0, Y1=0, Z1=0, X2=1, Y2=1, Z2=1)
number_slider = Slider(0.1, range=0..1)
grid = SubdivideGrid(MolaMesh=box, U=2, V=2, Iteration=1)
extrude_tapered = SubdivideExtrudeTapered(MolaMesh=grid, Height=Slider(1.5, range=0..2), Fraction=Slider(0.8, range=0..1), Cap=True, Iteration=1)
explode = MeshExplode(MolaMesh=grid)
catmullclark = SubdivideCatmullClark(MolaMesh=extrude_tapered, Iteration=1)
extrude_tapered_2 = SubdivideExtrudeTapered(MolaMesh=catmullclark, Height=Slider(0, range=0..100), Fraction=0.5, Cap=Toggle(False), Iteration=1)
number_slider_2 = Slider(3, range=0..10)
box_2 = MolaBox(X1=0, Y1=0, Z1=0, X2=1, Y2=1, Z2=1)
catmullclark_2 = SubdivideCatmullClark(MolaMesh=extrude_tapered_2, Iteration=1)
grid_2 = SubdivideGrid(MolaMesh=box_2, U=number_slider_2, V=number_slider_2, Iteration=1)
offset_face = SubdivideOffsetFace(MolaMesh=catmullclark_2, Offset=Slider(0.1, range=0..0.1), CloseBorders=True, Iteration=1)
extrude_tapered_3 = SubdivideExtrudeTapered(MolaMesh=grid_2, Height=1, Fraction=0.5, Cap=True, Iteration=1)
catmullclark_3 = SubdivideCatmullClark(MolaMesh=offset_face, Iteration=1)
catmullclark_4 = SubdivideCatmullClark(MolaMesh=extrude_tapered_3, Iteration=Slider(2, range=0..10))
face_area = AnalyzeFaceArea(MolaMesh=catmullclark_4)
to_rhino = MolaToRhino(MolaMesh=catmullclark_2, WithColor=Toggle(True))
topology = UpdateTopology(MolaMesh=catmullclark_4)
medges = MeshEdges(Mesh=to_rhino)  # -> NakedEdges, InteriorEdges, NonManifoldEdges
color = ColorMesh(MolaMesh=topology, Mode=2, SingleColor=RGB(255, 254, 254), ColorList=RGB(255, 254, 254), ValueList=face_area)
to_rhino_2 = MolaToRhino(MolaMesh=color, WithColor=True)
number_slider_3 = Slider(1, range=0..1)
torus = MolaTorus(R1=Slider(2, range=0..10), R2=1, RingN=Slider(45, range=0..100), TubeN=Slider(15, range=0..100))
grid_3 = SubdivideGrid(MolaMesh=torus, U=number_slider_3, V=number_slider_3, Iteration=1)
face_index = AnalyzeFaceIndex(MolaMesh=grid_3)
dodecahedron = MolaDodecahedron(X1=0, Y1=0, Z1=0, Radius=1)
face_modulo = AnalyzeFaceModulo(MolaMesh=grid_3, Modulo=Slider(2, range=0..10), N=Slider(0, range=0..100))
mod = Modulus(A=face_index, B=2)
face_location = AnalyzeFaceLocation(MolaMesh=grid_3)
split = MeshSplit(MolaMesh=grid_3, BooleanList=face_modulo)  # -> MolaMesh1, MolaMesh2
pdecon = Deconstruct(Point=face_location)  # -> XComponent, YComponent, ZComponent
bnd = Bounds(Numbers=pdecon.XComponent)
neg = Negative(Value=Slider(0.5, range=0..1))
panel = Panel(bnd)
toggle = BooleanToggle(True)
graph = GraphMapper(
    pdecon.XComponent,
    x0=-2.9366,
    x1=2.9366,
    y0=0,
    y1=1,
    A=1,
    B=0,
    container_name="Linear",
    Graph_x0=0.25,
    Graph_x1=0.75,
    Graph_y0=0.25,
    Graph_y1=0.75)
extrude_tapered_4 = SubdivideExtrudeTapered(MolaMesh=split.MolaMesh2, Height=neg, Fraction=Slider(0.2, range=0..1), Cap=Toggle(True), Iteration=1)
extrude_point_center_with_values = SubdivideExtrudeToPointCenterWithValues(MolaMesh=grid_3, HeightValues=graph, Iteration=1)
extrude_point_center = SubdivideExtrudeToPointCenter(MolaMesh=split.MolaMesh1, Height=Slider(0.5, range=0..2), Iteration=1)
face_area_2 = AnalyzeFaceArea(MolaMesh=extrude_point_center_with_values)
join = MeshJoin(MolaMeshes=[extrude_tapered_4, extrude_point_center])
color_2 = ColorMesh(
    MolaMesh=extrude_point_center_with_values,
    Mode=2,
    SingleColor=RGB(255, 254, 254),
    ColorList=RGB(255, 254, 254),
    ValueList=face_area_2)
face_location_2 = AnalyzeFaceLocation(MolaMesh=join)
face_index_2 = AnalyzeFaceIndex(MolaMesh=join)
to_rhino_3 = MolaToRhino(MolaMesh=extrude_tapered_4, WithColor=Toggle(True))
to_rhino_4 = MolaToRhino(MolaMesh=extrude_point_center, WithColor=toggle)
pdecon_2 = Deconstruct(Point=face_location_2)  # -> XComponent, YComponent, ZComponent
bnd_2 = Bounds(Numbers=pdecon_2.XComponent)
to_rhino_5 = MolaToRhino(MolaMesh=extrude_point_center_with_values, WithColor=Toggle(True))
panel_2 = Panel(bnd_2)
graph_2 = GraphMapper(
    pdecon_2.XComponent,
    x0=-3.1174,
    x1=3.1174,
    y0=0,
    y1=1,
    A=1,
    B=0,
    container_name="Linear",
    Graph_x0=0.25,
    Graph_x1=0.75,
    Graph_y0=0.25,
    Graph_y1=0.75)
color_3 = ColorMesh(MolaMesh=join, Mode=2, SingleColor=RGB(255, 254, 254), ColorList=RGB(255, 254, 254), ValueList=graph_2)
to_rhino_6 = MolaToRhino(MolaMesh=join, WithColor=toggle)
