# Grasshopper definition GetIconFromComponents.gh (Grasshopper 1.0.7)
# plug-ins: MetaHopper, HDMolaGH

mesh_join = MeshJoin()
analyze_face_index = AnalyzeFaceIndex()
# Place some components on the canvas, select them, and then hit the "Select" button on the above component.
selobj = GetSelectedObjects(AllObjects_Object=construct_point)  # -> ComponentObjects, ParamObjects, OtherObjects
ln = Line()
construct_point = ConstructPoint(XCoordinate=0, YCoordinate=0, ZCoordinate=0)

icon_save_location = Panel("C:\D\GitHub\HDMolaGH\install\icondesign\reference\{0}.png")
componenticon = CSharpScript(x=selobj.ComponentObjects)  # -> out, A
# ---------- componenticon: C# ----------
    IGH_ActiveObject comp = x as IGH_ActiveObject;
    A = comp.Icon_24x24;
# ---------- end componenticon ----------
txt = Text(selobj.ComponentObjects)
save_all_icons = BooleanToggle(True)
format = Format(Format=icon_save_location, Culture=127, Data0=txt)
c_script = CSharpScript(run=save_all_icons, BMP=componenticon.A, savePath=format)  # -> out, A; inputs run: Boolean, savePath: String
# ---------- c_script: C# ----------
    if(!run) return;
    Bitmap bmp = BMP as Bitmap;
    bmp.Save(savePath);
# ---------- end c_script ----------

disjoint_mesh = DisjointMesh()
