# Grasshopper definition icondesign.gh (Grasshopper 1.0.7)
# plug-ins: HDMolaGH, NGon

number_slider = Slider(1, range=0..1)
negative = Negative(Value=number_slider)
number_slider_2 = Slider(1, range=0..1)
mola_box = MolaBox(X1=negative, Y1=negative, Z1=negative, X2=number_slider, Y2=number_slider, Z2=number_slider)
point = Point(<point referenced from the Rhino model>)
point_2 = Point(<point referenced from the Rhino model>)
merge = Merge(
    Data1=Slider(0.2, range=0..1),
    Data2=Slider(0.4, range=0..1),
    Data3=Slider(0.5, range=0..1),
    Data4=Slider(0.2, range=0..1),
    Data5=Slider(0.3, range=0..1),
    Data6=Slider(0.7, range=0..1))
number_slider_3 = Slider(1, range=0..10)
number_slider_4 = Slider(-1, range=-1..0)
vector_2pt = Vector2Pt(PointA=point_2, PointB=point, Unitize=False)  # -> Vector, Length
negative_2 = Negative(Value=number_slider_2)
repeat_data = RepeatData(Data=Toggle(True), Length=Slider(6, range=0..10))
subtraction = Subtraction(A=1, B=number_slider)
number_slider_5 = Slider(0.4, range=0..1)
subdivide_grid = SubdivideGrid(MolaMesh=mola_box, U=number_slider_3, V=number_slider_3, Iteration=1)
mola_cone = MolaCone(Z1=0, Z2=1, R1=2, R2=1, Segments=6, CapBottom=True, CapTop=True)
mola_quad = MolaQuad(X1=0, Y1=0, Z1=0, X2=1, Y2=0, Z2=0, X3=1, Y3=1, Z3=0, X4=0, Y4=1, Z4=0)
mola_quad_2 = MolaQuad(
    X1=number_slider_2,
    Y1=negative_2,
    Z1=0,
    X2=number_slider_2,
    Y2=number_slider_2,
    Z2=0,
    X3=negative_2,
    Y3=number_slider_2,
    Z3=0,
    X4=negative_2,
    Y4=negative_2,
    Z4=0)
mola_box_2 = MolaBox(X1=number_slider_4, Y1=number_slider_4, Z1=number_slider_4, X2=1, Y2=1, Z2=1)
subdivide_extrude_values = SubdivideExtrudeValues(MolaMesh=mola_box, HeightValues=merge, Cap=repeat_data, Iteration=1)
subdivide_extrude_to_point_center = SubdivideExtrudeToPointCenter(MolaMesh=mola_box, Height=subtraction, Iteration=1)
subdivide_extrude_along_vec = SubdivideExtrudeAlongVec(MolaMesh=mola_box, Direction=vector_2pt.Vector, Height=Slider(0.7, range=0..1), Cap=True, Iteration=1)
mola_rhombicdodecahedron = MolaRhombicDodecahedron(X=0, Y=0, Z=0, Radius=1)
mola_circle = MolaCircle(X=0, Y=0, Z=0, Radius=1, Segments=6)
subdivide_catmullclark = SubdivideCatmullClark(MolaMesh=mola_box_2, Iteration=1)
number_slider_6 = Slider(0.5, range=0..1)
negative_3 = Negative(Value=Slider(0.4, range=0..1))
subdivide_extrude = SubdivideExtrude(MolaMesh=mola_box, Height=subtraction, Cap=True, Iteration=1)
subdivide_relative = SubdivideRelative(
    MolaMesh=mola_quad_2,
    StartDiriection=0,
    MinSplit1=number_slider_5,
    MaxSplit1=0.9,
    MinSplit2=number_slider_5,
    MaxSplit2=0.9,
    Iteration=1)
subdivide_split_grid_abs = SubdivideSplitGridAbs(USize=1, VSize=1, Iteration=1)
number_slider_7 = Slider(6, range=0..10)
mola_tetrahedron = MolaTetrahedron(X=0, Y=0, Z=0, Radius=1)
subdivide_offset = SubdivideOffset(MolaMesh=mola_quad_2, Offset=negative_3, Iteration=1)
mola_dodecahedron = MolaDodecahedron(X=0, Y=0, Z=0, Radius=1)
subdivide_split_frame = SubdivideSplitFrame(MolaMesh=mola_quad_2, Witdh=Slider(0.4, range=0..1), Iteration=1)
mola_dodecahedron_2 = MolaDodecahedron(X=0, Y=0, Z=0, Radius=1)
subdivide_linear_split_border = SubdivideLinearSplitBorder(MolaMesh=mola_quad_2, BorderWidth1=number_slider_6, BorderWidth2=number_slider_6, SplitDirection=0, Iteration=1)
mola_sphere = MolaSphere(Radius=1, X=0, Y=0, Z=0, URes=number_slider_7, VRes=number_slider_7)
subdivide_linear_split = SubdivideLinearSplit(MolaMesh=mola_quad_2, BorderWidth1=Slider(0.7, range=0..1), BorderWidth2=number_slider_6, SplitDirection=0, Iteration=1)
mola_to_rhino = MolaToRhino(MolaMesh=mola_quad_2, WithColor=False)
mola_icosahedron = MolaIcosahedron(X=0, Y=0, Z=0, Radius=1)
mola_torus = MolaTorus(R1=Slider(0.7, range=0..1), R2=Slider(0.4, range=0..1), RingN=6, TubeN=6)
mola_octahedron = MolaOctahedron(X=0, Y=0, Z=0, Radius=1)
explodemesh = ExplodeMesh(Mesh=mola_to_rhino, Explode=False)
