# Grasshopper definition molaGHExample.gh (Grasshopper 1.0.7)
# plug-ins: HDMolaGH

# ---- group: Primitive
number_slider = Slider(10, range=0..10)
number_slider_2 = Slider(8, range=0..10)
quad = Quad(
    X1=0,
    Y1=0,
    Z1=0,
    X2=number_slider,
    Y2=0,
    Z2=0,
    X3=number_slider,
    Y3=number_slider_2,
    Z3=0,
    X4=0,
    Y4=number_slider_2,
    Z4=0)

# ---- group: Subdivide
extrude = SubdivideExtrude(Mesh=quad, Height=Slider(20, range=0..100), Cap=True, Iteration=1)

# ---- group: Filter
byindex = FilterByIndex(Mesh=extrude, Index=Slider(4, range=0..10))  # -> Mesh1, Mesh2

# ---- group: Subdivision
number_slider_3 = Slider(5, range=0..10)
grid = SubdivideGrid(Mesh=byindex.Mesh2, U=number_slider_3, V=number_slider_3, Iteration=1)
extrudetapered = SubdivideExtrudeTapered(Mesh=grid, Height=0.5, Fraction=0.2, Cap=True, Iteration=1)

# ---- group: Filter
bymodulo = FilterByModulo(Mesh=extrudetapered, Index=4, Modulo=5)  # -> Mesh1, Mesh2

# ----
preview = CustomPreview(Geometry=byindex.Mesh1, Material=ColourSwatch(SwatchColor=RGB(43, 255, 57)))
preview_2 = CustomPreview(Geometry=bymodulo.Mesh2, Material=ColourSwatch(SwatchColor=RGB(255, 133, 133)))
preview_3 = CustomPreview(Geometry=bymodulo.Mesh1, Material=ColourSwatch(SwatchColor=RGB(79, 140, 134)))
