# Grasshopper definition unnamed.gh (Grasshopper 1.0.7)
# plug-ins: HDMolaGH

box = Box(X1=0, Y1=0, Z1=0, X2=1, Y2=1, Z2=1)  # disabled
quad = MolaQuad(X1=0, Y1=0, Z1=0, X2=1, Y2=0, Z2=0, X3=1, Y3=1, Z3=0, X4=0, Y4=1, Z4=0)
number_slider = Slider(0.2, range=0..1)  # disabled
number_slider_2 = Slider(2, range=0..10)  # disabled
grid = SubdivideGrid(MolaMesh=quad, U=2, V=Slider(1, range=0..1), Iteration=Slider(1, range=1..40))
extrudetapered = SubdivideExtrudeTapered(MolaMesh=box, Height=number_slider, Fraction=0.5, Cap=True, Iteration=number_slider_2)  # disabled
face_index = AnalyzeFaceIndex(MolaMesh=extrudetapered)  # disabled
face_area = AnalyzeFaceArea(MolaMesh=extrudetapered)  # disabled
analyze_mesh = AnalyzeMolaMesh(MolaMesh=grid)  # -> VerticeCount, FaceCount
color = ColorMesh(MolaMesh=extrudetapered, ValueList=face_index)  # disabled
analyze_mesh_2 = AnalyzeMolaMesh(MolaMesh=extrudetapered)  # -> VerticeCount, FaceCount; disabled
panel = Panel(analyze_mesh.FaceCount)
panel_2 = Panel(color)  # disabled
torhino = MolaToRhino(MolaMesh=color)  # disabled
