# Grasshopper definition BuildingB.gh (Grasshopper 1.0.7)
# plug-ins: HDMolaGH

box = MolaBox(X1=0, Y1=0, Z1=0, X2=1, Y2=1, Z2=1)
extrude_tapered = SubdivideExtrudeTapered(MolaMesh=box, Height=Slider(0.1, range=0..0.1), Fraction=Slider(0.6, range=0..1), Cap=True, Iteration=1)
face_modulo = AnalyzeFaceModulo(MolaMesh=extrude_tapered, Modulo=5, N=4)
split = MeshSplit(MolaMesh=extrude_tapered, BooleanList=face_modulo)  # -> MolaMesh1, MolaMesh2
to_rhino = MolaToRhino(MolaMesh=split.MolaMesh2, WithColor=Toggle(True))
extrude = SubdivideExtrude(MolaMesh=split.MolaMesh1, Height=Slider(0.5, range=0..1), Cap=True, Iteration=1)
extrude_tapered_2 = SubdivideExtrudeTapered(MolaMesh=extrude, Height=Slider(0.1, range=0..0.1), Fraction=Slider(0.6, range=0..1), Cap=True, Iteration=1)
to_rhino_2 = MolaToRhino(MolaMesh=extrude_tapered_2, WithColor=Toggle(True))
face_modulo_2 = AnalyzeFaceModulo(MolaMesh=extrude_tapered_2, Modulo=5, N=4)
split_2 = MeshSplit(MolaMesh=extrude_tapered_2, BooleanList=face_modulo_2)  # -> MolaMesh1, MolaMesh2
to_rhino_3 = MolaToRhino(MolaMesh=split_2.MolaMesh2, WithColor=Toggle(True))
extrude_tapered_3 = SubdivideExtrudeTapered(MolaMesh=split_2.MolaMesh1, Height=Slider(0.254, range=0..1), Fraction=Slider(0.5, range=0..1), Cap=True, Iteration=1)
to_rhino_4 = MolaToRhino(MolaMesh=extrude_tapered_3, WithColor=Toggle(True))
face_modulo_3 = AnalyzeFaceModulo(MolaMesh=extrude_tapered_3, Modulo=5, N=4)
split_3 = MeshSplit(MolaMesh=extrude_tapered_3, BooleanList=face_modulo_3)  # -> MolaMesh1, MolaMesh2
number_slider = Slider(2, range=0..10)
number_slider_2 = Slider(1, range=0..1)
extrude_2 = SubdivideExtrude(MolaMesh=split_3.MolaMesh1, Height=1, Cap=True, Iteration=1)
join = MeshJoin(MolaMeshes=[split.MolaMesh2, extrude_tapered_2, split_2.MolaMesh2, split_3.MolaMesh2, extrude_2])
catmullclark = SubdivideCatmullClark(MolaMesh=join, Iteration=Slider(0, range=0..10))
grid = SubdivideGrid(MolaMesh=catmullclark, U=number_slider, V=number_slider, Iteration=1)
extrude_tapered_4 = SubdivideExtrudeTapered(MolaMesh=grid, Height=Slider(0, range=0..1), Fraction=Slider(0.2, range=0..1), Cap=True, Iteration=1)
face_modulo_4 = AnalyzeFaceModulo(MolaMesh=extrude_tapered_4, Modulo=5, N=4)
split_4 = MeshSplit(MolaMesh=extrude_tapered_4, BooleanList=face_modulo_4)  # -> MolaMesh1, MolaMesh2
face_location = AnalyzeFaceLocation(MolaMesh=split_4.MolaMesh2)
pdecon = Deconstruct(Point=face_location)  # -> XComponent, YComponent, ZComponent
face_location_2 = AnalyzeFaceLocation(MolaMesh=split_4.MolaMesh1)
larger = LargerThan(FirstNumber=pdecon.ZComponent, SecondNumber=0)  # -> LargerThan, OrEqualTo
pdecon_2 = Deconstruct(Point=face_location_2)  # -> XComponent, YComponent, ZComponent
split_5 = MeshSplit(MolaMesh=split_4.MolaMesh2, BooleanList=larger.OrEqualTo)  # -> MolaMesh1, MolaMesh2
larger_2 = LargerThan(FirstNumber=pdecon_2.ZComponent, SecondNumber=0)  # -> LargerThan, OrEqualTo
split_6 = MeshSplit(MolaMesh=split_4.MolaMesh1, BooleanList=larger_2.OrEqualTo)  # -> MolaMesh1, MolaMesh2
color = ColorMesh(
    MolaMesh=split_6.MolaMesh1,
    Mode=0,
    SingleColor=ColourSwatch(SwatchColor=RGB(0, 0, 0)),
    ColorList=RGB(255, 255, 255),
    ValueList=0)
to_rhino_5 = MolaToRhino(MolaMesh=color, WithColor=Toggle(True))

face_index = AnalyzeFaceIndex(MolaMesh=split_5.MolaMesh1)
bnd = Bounds(Numbers=face_index)
dedomain = DeconstructDomain(Domain=bnd)  # -> Start, End

gradient = Gradient(
    LowerLimit=dedomain.Start,
    UpperLimit=dedomain.End,
    Parameter=face_index,
    stops=[0.15: RGB(255, 130, 160), 0.85: RGB(220, 0, 40)])

color_2 = ColorMesh(MolaMesh=split_5.MolaMesh1, Mode=Slider(1, range=0..1), SingleColor=RGB(255, 255, 255), ColorList=gradient, ValueList=0)
to_rhino_6 = MolaToRhino(MolaMesh=color_2, WithColor=Toggle(True))
