# Grasshopper definition BuildingC.gh (Grasshopper 1.0.7)
# plug-ins: HDMolaGH

number_slider = Slider(50, range=0..100)
number_slider_2 = Slider(50, range=0..100)
quad = MolaQuad(X1=0, Y1=0, Z1=0, X2=number_slider, Y2=0, Z2=0, X3=number_slider, Y3=number_slider, Z3=0, X4=0, Y4=number_slider, Z4=0)
quad_2 = MolaQuad(
    X1=0,
    Y1=0,
    Z1=0,
    X2=number_slider_2,
    Y2=0,
    Z2=0,
    X3=number_slider_2,
    Y3=number_slider_2,
    Z3=0,
    X4=0,
    Y4=number_slider_2,
    Z4=0)
number_slider_3 = Slider(51, range=0..100)
to_rhino = MolaToRhino(MolaMesh=quad_2, WithColor=True)
division = Division(A=number_slider_3, B=2)
extrude_point_center = SubdivideExtrudeToPointCenter(MolaMesh=quad, Height=number_slider_3, Iteration=1)
Z = UnitZ(Factor=division)
move = Move(Geometry=to_rhino, Motion=Z)  # -> Geometry, Transform
area = Area(Geometry=move.Geometry)  # -> Area, Centroid
extrude_tapered = SubdivideExtrudeTapered(MolaMesh=extrude_point_center, Height=0, Fraction=Slider(0.2, range=0..1), Cap=False, Iteration=1)
scale = Scale(Geometry=move.Geometry, Center=area.Centroid, Factor=Slider(0.6, range=0..1))  # -> Geometry, Transform
split_frame = SubdivideSplitFrame(MolaMesh=extrude_point_center, Witdh=Slider(6, range=0..10), Iteration=1)
to_mola = RhinoToMola(RhinoMesh=scale.Geometry)
offset_face = SubdivideOffsetFace(MolaMesh=extrude_tapered, Offset=Slider(3, range=0..10), CloseBorders=True, Iteration=1)
neg = Negative(Value=Slider(21, range=0..100))
to_rhino_2 = MolaToRhino(MolaMesh=offset_face, WithColor=True)
extrude_point_center_2 = SubdivideExtrudeToPointCenter(MolaMesh=to_mola, Height=neg, Iteration=1)
to_rhino_3 = MolaToRhino(MolaMesh=extrude_point_center_2, WithColor=True)
