# Grasshopper definition BuildingF.gh (Grasshopper 1.0.7)
# plug-ins: HDMolaGH

number_slider = Slider(9, range=0..100)
number_slider_2 = Slider(9, range=0..10)
number_slider_3 = Slider(8, range=0..10)
toggle = BooleanToggle(False)
number_slider_4 = Slider(12, range=0..100)
subtraction = Subtraction(A=number_slider_2, B=Slider(3, range=0..10))
subtraction_2 = Subtraction(A=subtraction, B=Slider(2, range=0..11))
neg = Negative(Value=number_slider)
addition = Addition(A=number_slider_3, B=Slider(3, range=0..10))
addition_2 = Addition(A=addition, B=Slider(6, range=0..10))
addition_3 = Addition(A=addition_2, B=Slider(2, range=0..10))
addition_4 = Addition(A=addition_3, B=Slider(5, range=0..10))
addition_5 = Addition(A=addition_4, B=Slider(4, range=0..10))
quad = MolaQuad(
    X1=neg,
    Y1=neg,
    Z1=0,
    X2=number_slider,
    Y2=neg,
    Z2=0,
    X3=number_slider,
    Y3=number_slider,
    Z3=0,
    X4=neg,
    Y4=number_slider,
    Z4=0)
cone = MolaCone(
    Z1=0,
    Z2=number_slider_3,
    R1=number_slider_2,
    R2=number_slider_2,
    Segments=number_slider_4,
    CapBottom=toggle,
    CapTop=False)
cone_2 = MolaCone(Z1=addition_2, Z2=addition_3, R1=subtraction, R2=subtraction_2, Segments=number_slider_4, CapBottom=toggle, CapTop=False)
cone_3 = MolaCone(
    Z1=addition_4,
    Z2=addition_5,
    R1=subtraction_2,
    R2=Slider(0, range=0..100),
    Segments=number_slider_4,
    CapBottom=toggle,
    CapTop=False)
cone_4 = MolaCone(
    Z1=addition_3,
    Z2=addition_4,
    R1=subtraction_2,
    R2=subtraction_2,
    Segments=number_slider_4,
    CapBottom=toggle,
    CapTop=False)
cone_5 = MolaCone(Z1=addition, Z2=addition_2, R1=subtraction, R2=subtraction, Segments=number_slider_4, CapBottom=toggle, CapTop=False)
cone_6 = MolaCone(
    Z1=number_slider_3,
    Z2=addition,
    R1=number_slider_2,
    R2=subtraction,
    Segments=number_slider_4,
    CapBottom=toggle,
    CapTop=False)
extrude = SubdivideExtrude(MolaMesh=quad, Height=Slider(10, range=0..10), Cap=True, Iteration=1)

face_normal = AnalyzeFaceNormal(MolaMesh=extrude)
pdecon = Deconstruct(Point=face_normal)  # -> XComponent, YComponent, ZComponent
abs = Absolute(Value=pdecon.ZComponent)
larger = LargerThan(FirstNumber=abs, SecondNumber=0)  # -> LargerThan, OrEqualTo
split = MeshSplit(MolaMesh=extrude, BooleanList=larger.LargerThan)  # -> MolaMesh1, MolaMesh2
extrude_2 = SubdivideExtrude(MolaMesh=split.MolaMesh2, Height=Slider(10, range=0..10), Cap=True, Iteration=1)
face_modulo = AnalyzeFaceModulo(MolaMesh=extrude_2, Modulo=5, N=Slider(2, range=0..10))
split_2 = MeshSplit(MolaMesh=extrude_2, BooleanList=face_modulo)  # -> MolaMesh1, MolaMesh2
split_roof = SubdivideSplitRoof(MolaMesh=split_2.MolaMesh1, Height=Slider(4, range=0..10), Iteration=1)
extrude_3 = SubdivideExtrude(MolaMesh=split.MolaMesh1, Height=Slider(9, range=0..10), Cap=True, Iteration=1)

join = MeshJoin(MolaMeshes=[cone, cone_6, cone_5, cone_2, cone_4, cone_3])

face_normal_2 = AnalyzeFaceNormal(MolaMesh=extrude_3)
pdecon_2 = Deconstruct(Point=face_normal_2)  # -> XComponent, YComponent, ZComponent
abs_2 = Absolute(Value=pdecon_2.ZComponent)
larger_2 = LargerThan(FirstNumber=abs_2, SecondNumber=0)  # -> LargerThan, OrEqualTo
split_3 = MeshSplit(MolaMesh=extrude_3, BooleanList=larger_2.LargerThan)  # -> MolaMesh1, MolaMesh2
extrude_4 = SubdivideExtrude(MolaMesh=split_3.MolaMesh2, Height=Slider(6, range=0..10), Cap=True, Iteration=1)
face_modulo_2 = AnalyzeFaceModulo(MolaMesh=extrude_4, Modulo=5, N=Slider(2, range=0..10))
split_4 = MeshSplit(MolaMesh=extrude_4, BooleanList=face_modulo_2)  # -> MolaMesh1, MolaMesh2
split_roof_2 = SubdivideSplitRoof(MolaMesh=split_4.MolaMesh1, Height=Slider(6, range=0..10), Iteration=1)
extrude_5 = SubdivideExtrude(MolaMesh=split_3.MolaMesh1, Height=Slider(8, range=0..10), Cap=True, Iteration=1)

face_normal_3 = AnalyzeFaceNormal(MolaMesh=extrude_5)
pdecon_3 = Deconstruct(Point=face_normal_3)  # -> XComponent, YComponent, ZComponent
abs_3 = Absolute(Value=pdecon_3.ZComponent)
larger_3 = LargerThan(FirstNumber=abs_3, SecondNumber=0)  # -> LargerThan, OrEqualTo
split_5 = MeshSplit(MolaMesh=extrude_5, BooleanList=larger_3.LargerThan)  # -> MolaMesh1, MolaMesh2
extrude_point_center = SubdivideExtrudeToPointCenter(MolaMesh=split_5.MolaMesh1, Height=Slider(7, range=0..10), Iteration=1)
to_rhino = MolaToRhino(MolaMesh=extrude_point_center, WithColor=True)
pt = Point(Point(18.51215391, 0.1447215974, 0))
pt_2 = Point(Point(-18.51215391, 0.1447215974, 0))
topology = UpdateTopology(MolaMesh=join)
vec2pt = Vector2Pt(PointA="0,0,0", PointB=[pt, pt_2], Unitize=False)  # -> Vector, Length
to_rhino_2 = MolaToRhino(MolaMesh=topology, WithColor=True)
move = Move(Geometry=to_rhino_2, Motion=vec2pt.Vector)  # -> Geometry, Transform
to_mola = RhinoToMola(RhinoMesh=move.Geometry)
move_2 = Move(Geometry=to_rhino_2, Motion=vec2pt.Vector)  # -> Geometry, Transform
to_mola_2 = RhinoToMola(RhinoMesh=move_2.Geometry)
join_2 = MeshJoin(MolaMeshes=flatten([split_2.MolaMesh2, split_roof, split_roof_2, split_4.MolaMesh2, split_5.MolaMesh2, extrude_point_center, to_mola_2, to_mola]))
topology_2 = UpdateTopology(MolaMesh=join_2)
face_normal_4 = AnalyzeFaceNormal(MolaMesh=topology_2)
pdecon_4 = Deconstruct(Point=face_normal_4)  # -> XComponent, YComponent, ZComponent
abs_4 = Absolute(Value=pdecon_4.ZComponent)
larger_4 = LargerThan(FirstNumber=abs_4, SecondNumber=0)  # -> LargerThan, OrEqualTo
split_6 = MeshSplit(MolaMesh=topology_2, BooleanList=larger_4.LargerThan)  # -> MolaMesh1, MolaMesh2
sort = SortList(Keys=abs_4)  # -> Keys, ValuesA
color = ColorMesh(
    MolaMesh=split_6.MolaMesh1,
    Mode=0,
    SingleColor=ColourSwatch(SwatchColor=RGB(87, 87, 87)),
    ColorList=RGB(255, 255, 255),
    ValueList=0)
to_rhino_3 = MolaToRhino(MolaMesh=color, WithColor=True)
to_rhino_4 = MolaToRhino(MolaMesh=split_6.MolaMesh2, WithColor=True)
