# Grasshopper definition logo.gh (Grasshopper 1.0.7)
# plug-ins: HDMolaGH

number_slider = Slider(9, range=0..10)
number_slider_2 = Slider(6, range=0..10)
mola_box = MolaBox(X1=0, Y1=0, Z1=0, X2=Slider(2, range=0..10), Y2=1, Z2=Slider(1.4, range=0..10))
mola_icosahedron = MolaIcosahedron(X=0, Y=0, Z=0, Radius=1)
mola_sphere = MolaSphere(Radius=1, X=0, Y=0, Z=0, URes=number_slider, VRes=number_slider)
number_slider_3 = Slider(9, range=0..10)
number_slider_4 = Slider(6, range=0..10)
subdivide_catmullclark = SubdivideCatmullClark(MolaMesh=mola_box, Iteration=Slider(1, range=0..10))
mola_box_2 = MolaBox(X1=0, Y1=0, Z1=0, X2=Slider(2, range=0..10), Y2=1, Z2=Slider(1.4, range=0..10))
analyze_face_location = AnalyzeFaceLocation(MolaMesh=subdivide_catmullclark)
mola_icosahedron_2 = MolaIcosahedron(X=0, Y=0, Z=0, Radius=1)
analyze_face_normal = AnalyzeFaceNormal(MolaMesh=subdivide_catmullclark)
analyze_face_index = AnalyzeFaceIndex(MolaMesh=mola_icosahedron)
update_topology = UpdateTopology(MolaMesh=subdivide_catmullclark)
mola_sphere_2 = MolaSphere(Radius=1, X=0, Y=0, Z=0, URes=number_slider_3, VRes=number_slider_3)
subdivide_catmullclark_2 = SubdivideCatmullClark(MolaMesh=mola_box_2, Iteration=Slider(2, range=0..10))
analyze_face_location_2 = AnalyzeFaceLocation(MolaMesh=subdivide_catmullclark_2)
deconstruct = Deconstruct(Point=analyze_face_normal)  # -> XComponent, YComponent, ZComponent
analyze_face_normal_2 = AnalyzeFaceNormal(MolaMesh=subdivide_catmullclark_2)
analyze_face_index_2 = AnalyzeFaceIndex(MolaMesh=mola_icosahedron_2)
panel = Panel(deconstruct.XComponent)
update_topology_2 = UpdateTopology(MolaMesh=subdivide_catmullclark_2)
vector_display = VectorDisplay(Anchor=analyze_face_location_2, Vector=analyze_face_normal_2)
deconstruct_2 = Deconstruct(Point=analyze_face_normal_2)  # -> XComponent, YComponent, ZComponent
larger_than = LargerThan(FirstNumber=deconstruct.XComponent, SecondNumber=Slider(0.6, range=0..1))  # -> LargerThan, OrEqualTo
mesh_split = MeshSplit(MolaMesh=update_topology, BooleanList=larger_than.LargerThan)  # -> MolaMesh1, MolaMesh2
unit_x = UnitX(Factor=1)
number_slider_5 = Slider(0.2, range=0..1)
analyze_face_normal_3 = AnalyzeFaceNormal(MolaMesh=mesh_split.MolaMesh2)
number_slider_6 = Slider(0, range=-0.9..0.9)
panel_2 = Panel(analyze_face_normal_2)
number_slider_7 = Slider(0, range=0..0.1)
deconstruct_3 = Deconstruct(Point=analyze_face_normal_3)  # -> XComponent, YComponent, ZComponent
larger_than_2 = LargerThan(FirstNumber=deconstruct_3.XComponent, SecondNumber=0)  # -> LargerThan, OrEqualTo
subdivide_extrude_tapered_along_vec = SubdivideExtrudeTaperedAlongVec(MolaMesh=mesh_split.MolaMesh1, Direction=unit_x, Height=number_slider_5, Fraction=number_slider_6, Cap=True, Iteration=1)
larger_than_3 = LargerThan(FirstNumber=deconstruct_2.XComponent, SecondNumber=Slider(0.7, range=0..1))  # -> LargerThan, OrEqualTo
mesh_split_2 = MeshSplit(MolaMesh=update_topology_2, BooleanList=larger_than_3.LargerThan)  # -> MolaMesh1, MolaMesh2
analyze_face_normal_4 = AnalyzeFaceNormal(MolaMesh=mesh_split_2.MolaMesh2)
subdivide_extrude_tapered = SubdivideExtrudeTapered(MolaMesh=mesh_split.MolaMesh1, Height=number_slider_5, Fraction=number_slider_6, Cap=True, Iteration=1)
subdivide_extrude_tapered_2 = SubdivideExtrudeTapered(
    MolaMesh=mesh_split_2.MolaMesh1,
    Height=Slider(0.18, range=0..1),
    Fraction=Slider(-0.33, range=-0.5..0.5),
    Cap=True,
    Iteration=1)
deconstruct_4 = Deconstruct(Point=analyze_face_normal_4)  # -> XComponent, YComponent, ZComponent
larger_than_4 = LargerThan(FirstNumber=deconstruct_4.XComponent, SecondNumber=0)  # -> LargerThan, OrEqualTo
mesh_split_3 = MeshSplit(MolaMesh=mesh_split.MolaMesh2, BooleanList=larger_than_2.LargerThan)  # -> MolaMesh1, MolaMesh2
analyze_face_normal_5 = AnalyzeFaceNormal(MolaMesh=mesh_split_3.MolaMesh1)
sort_list = SortList(Keys=deconstruct_4.XComponent)  # -> Keys, ValuesValuesA
mesh_split_4 = MeshSplit(MolaMesh=mesh_split_2.MolaMesh2, BooleanList=larger_than_4.LargerThan)  # -> MolaMesh1, MolaMesh2
deconstruct_5 = Deconstruct(Point=analyze_face_normal_5)  # -> XComponent, YComponent, ZComponent
analyze_face_normal_6 = AnalyzeFaceNormal(MolaMesh=mesh_split_4.MolaMesh1)
sort_list_2 = SortList(Keys=deconstruct_5.ZComponent)  # -> Keys, ValuesValuesA
deconstruct_6 = Deconstruct(Point=analyze_face_normal_6)  # -> XComponent, YComponent, ZComponent
larger_than_5 = LargerThan(FirstNumber=deconstruct_5.ZComponent, SecondNumber=Slider(0.7, range=0..1))  # -> LargerThan, OrEqualTo
panel_3 = Panel(sort_list_2.Keys)
sort_list_3 = SortList(Keys=deconstruct_6.ZComponent)  # -> Keys, ValuesValuesA
absolute = Absolute(Value=deconstruct_6.ZComponent)
mesh_split_5 = MeshSplit(MolaMesh=mesh_split_3.MolaMesh1, BooleanList=larger_than_5.LargerThan)  # -> MolaMesh1, MolaMesh2
analyze_face_normal_7 = AnalyzeFaceNormal(MolaMesh=mesh_split_5.MolaMesh2)
larger_than_6 = LargerThan(FirstNumber=absolute, SecondNumber=0.9)  # -> LargerThan, OrEqualTo
mesh_split_6 = MeshSplit(MolaMesh=mesh_split_4.MolaMesh1, BooleanList=larger_than_6.LargerThan)  # -> MolaMesh1, MolaMesh2
subdivide_extrude_along_vec = SubdivideExtrudeAlongVec(MolaMesh=mesh_split_6.MolaMesh1, Direction=Vector(0, 0, 1), Height=Slider(0.5, range=0..1), Cap=True, Iteration=1)
panel_4 = Panel(sort_list_3.Keys)
deconstruct_7 = Deconstruct(Point=analyze_face_normal_7)  # -> XComponent, YComponent, ZComponent
subdivide_extrude_tapered_3 = SubdivideExtrudeTapered(MolaMesh=mesh_split_6.MolaMesh1, Height=Slider(0.5, range=0..1), Fraction=Slider(0.8, range=0..1), Cap=True, Iteration=1)
mesh_join = MeshJoin(MolaMeshes=[subdivide_extrude_tapered_2, mesh_split_4.MolaMesh2, mesh_split_6.MolaMesh2, subdivide_extrude_tapered_3])
color_mesh = ColorMesh(
    MolaMesh=mesh_join,
    Mode=0,
    SingleColor=ColourSwatch(SwatchColor=RGB(222, 109, 186)),
    ColorList=RGB(255, 255, 255),
    ValueList=0)
smaller_than = SmallerThan(FirstNumber=deconstruct_7.ZComponent, SecondNumber=Slider(-0.7, range=-0.9..0.9))  # -> SmallerThan, OrEqualTo
mola_to_rhino = MolaToRhino(MolaMesh=color_mesh, WithColor=Toggle(False))
unit_z = UnitZ(Factor=1)
number_slider_8 = Slider(0.8, range=0..1)
number_slider_9 = Slider(0.7, range=0..1)
mesh_split_7 = MeshSplit(MolaMesh=mesh_split_5.MolaMesh2, BooleanList=smaller_than.SmallerThan)  # -> MolaMesh1, MolaMesh2
negative = Negative(Value=unit_z)
mola_to_rhino_2 = MolaToRhino(MolaMesh=mesh_split_4.MolaMesh1, WithColor=True)
subdivide_extrude_tapered_along_vec_2 = SubdivideExtrudeTaperedAlongVec(
    MolaMesh=mesh_split_5.MolaMesh1,
    Direction=unit_z,
    Height=number_slider_9,
    Fraction=number_slider_8,
    Cap=True,
    Iteration=1)
subdivide_extrude_tapered_4 = SubdivideExtrudeTapered(MolaMesh=mesh_split_5.MolaMesh1, Height=number_slider_9, Fraction=number_slider_8, Cap=True, Iteration=1)
subdivide_extrude_tapered_along_vec_3 = SubdivideExtrudeTaperedAlongVec(
    MolaMesh=mesh_split_7.MolaMesh1,
    Direction=negative,
    Height=number_slider_9,
    Fraction=number_slider_8,
    Cap=True,
    Iteration=1)
mesh_join_2 = MeshJoin(MolaMeshes=[mesh_split_3.MolaMesh2, subdivide_extrude_tapered_along_vec, mesh_split_7.MolaMesh2, subdivide_extrude_tapered_along_vec_2, subdivide_extrude_tapered_along_vec_3])
color_mesh_2 = ColorMesh(
    MolaMesh=mesh_join_2,
    Mode=0,
    SingleColor=ColourSwatch(SwatchColor=RGB(222, 109, 186)),
    ColorList=RGB(255, 255, 255),
    ValueList=0)
mola_to_rhino_3 = MolaToRhino(MolaMesh=color_mesh_2, WithColor=Toggle(False))
