# Grasshopper definition molavoxelExamples.gh (Grasshopper 1.0.7)
# plug-ins: HDMolaGH

# ---- group: create grid
grid = Grid(X=10, Y=10, Z=10, Type=0)

# ---- group: geometry
random = CSharpScript(input=grid, Reference=["C:\D\GitHub\HDMolaGH\install\HDMola.dll", "C:\D\GitHub\HDMolaGH\install\netstandard.dll"])  # -> out, A
# ---------- random: C# usings ----------
using Mola;
# ---------- random: C# ----------
    MolaGrid<bool> grid = (MolaGrid<bool>) input;
    grid = grid.Copy();
    //MolaGrid<bool> gridCopy = grid.Copy();
    var rand = new Random();
    for (int i = 0; i < grid.Count; i++)
    {
      grid[i] = rand.NextDouble() > 0.5;
    }
    A = grid;
# ---------- end random ----------
sphere = CSharpScript(
    input=grid,
    radius=5,
    Reference=["C:\D\GitHub\HDMolaGH\install\HDMola.dll", "C:\D\GitHub\HDMolaGH\install\netstandard.dll"])  # -> out, A; inputs radius: Double
# ---------- sphere: C# ----------
    MolaGrid<bool> grid = (MolaGrid<bool>) input;
    grid = grid.Copy();
    //MolaGrid<bool> gridCopy = new MolaGrid<bool>(10, 10, 10);
    //gridCopy = grid.Copy();
    float radiusSquare = Mathf.Pow((float) radius, 2);
    for (int i = 0; i < grid.Count; i++)
    {
      float dx = Mathf.Pow(grid.getX(i) - 0, 2);
      float dy = Mathf.Pow(grid.getY(i) - 0, 2);
      float dz = Mathf.Pow(grid.getZ(i) - 0, 2);

      float dSquare = dx + dy + dz;
      if (dSquare <= radiusSquare)
      {
        grid[i] = true;
      }
    }
    A = grid;
# ---------- end sphere ----------
box = CSharpScript(input=grid, Reference=["C:\D\GitHub\HDMolaGH\install\HDMola.dll", "C:\D\GitHub\HDMolaGH\install\netstandard.dll"])  # -> out, A
# ---------- box: C# ----------
    MolaGrid<bool> grid = (MolaGrid<bool>) input;
    grid = grid.Copy();
    //MolaGrid<bool> gridCopy = grid.Copy();
    for (int i = 0; i < grid.Count; i++)
    {
      if (grid.getX(i) == 1)
      {
        grid[i] = true;
      }
    }
    A = grid;
# ---------- end box ----------
gyroid = CSharpScript(input=grid, Reference=["C:\D\GitHub\HDMolaGH\install\HDMola.dll", "C:\D\GitHub\HDMolaGH\install\netstandard.dll"])  # -> out, A
# ---------- gyroid: C# ----------
    MolaGrid<bool> grid = (MolaGrid<bool>) input;
    grid = grid.Copy();
    float x = 0;
    float y = 0;
    float z = 0;
    float scale = 1;
    float thickness = 0.5f;
    for (int i = 0; i < grid.Count; i++)
    {
      float distValue = Mola.Mathf.Sin((grid.getX(i) - x) / scale) + Mola.Mathf.Sin((grid.getY(i) - y) / scale) + Mola.Mathf.Sin((grid.getZ(i) - z) / scale);
      grid[i] = Mola.Mathf.Abs(distValue) < thickness;
    }


    A = grid;
# ---------- end gyroid ----------

# ----
copy = CSharpScript(input=grid, Reference=["C:\D\GitHub\HDMolaGH\install\HDMola.dll", "C:\D\GitHub\HDMolaGH\install\netstandard.dll"])  # -> out, A
# ---------- copy: C# ----------
    MolaGrid<bool> grid = (MolaGrid<bool>) input;
    grid = grid.Copy();
    A = grid;
# ---------- end copy ----------

# ---- group: bool operatiion
bool_union = CSharpScript(
    input=grid,
    a=sphere.A,
    b=box.A,
    Reference=["C:\D\GitHub\HDMolaGH\install\HDMola.dll", "C:\D\GitHub\HDMolaGH\install\netstandard.dll"])  # -> out, A; inputs a: list, b: list
# ---------- bool_union: C# ----------
    MolaGrid<bool> grid = (MolaGrid<bool>) input;
    grid = grid.Copy();
    for (int i = 0; i < grid.Count; i++)
    {
      grid[i] = (bool)a[i] || (bool)b[i];
    }
    A = grid;
# ---------- end bool_union ----------
bool_intersection = CSharpScript(
    input=grid,
    a=sphere.A,
    b=box.A,
    Reference=["C:\D\GitHub\HDMolaGH\install\HDMola.dll", "C:\D\GitHub\HDMolaGH\install\netstandard.dll"])  # -> out, A; inputs a: list, b: list
# ---------- bool_intersection: C# ----------
    MolaGrid<bool> grid = (MolaGrid<bool>) input;
    grid = grid.Copy();
    for (int i = 0; i < grid.Count; i++)
    {
      grid[i] = (bool) a[i] && (bool) b[i];
    }
    A = grid;
# ---------- end bool_intersection ----------
bool_difference = CSharpScript(
    input=grid,
    a=sphere.A,
    b=box.A,
    Reference=["C:\D\GitHub\HDMolaGH\install\HDMola.dll", "C:\D\GitHub\HDMolaGH\install\netstandard.dll"])  # -> out, A; inputs a: list, b: list
# ---------- bool_difference: C# ----------
    MolaGrid<bool> grid = (MolaGrid<bool>) input;
    grid = grid.Copy();
    for (int i = 0; i < grid.Count; i++)
    {
      grid[i] = (bool) a[i] && !(bool) b[i];
    }
    A = grid;
# ---------- end bool_difference ----------

# ---- group: grid to mola
tomola = CSharpScript(
    x=grid,
    y=bool_difference.A,
    Reference=["C:\D\GitHub\HDMolaGH\install\HDMola.dll", "C:\D\GitHub\HDMolaGH\install\netstandard.dll"])  # -> out, A; inputs y: list of Boolean
# ---------- tomola: C# ----------
    MolaGrid<bool> grid = (MolaGrid<bool>) x;
    MolaGrid<bool> gridCopy = grid.Copy();
    for (int i = 0; i < gridCopy.Count; i++)
    {
      gridCopy[i] = y[i];
    }
    MolaMesh mesh = UtilsGrid.VoxelMesh(gridCopy);
    A = mesh;
# ---------- end tomola ----------

# ----
to_rhino = MolaToRhino(MolaMesh=tomola.A, WithColor=True)
