# Grasshopper definition starShapeExample.gh (Grasshopper 1.0.7)
# plug-ins: HDMolaGH

number_slider = Slider(10, range=0..10)
cone = MolaCone(Z1=0, Z2=10, R1=number_slider, R2=number_slider, Segments=Slider(10, range=3..18), CapBottom=True, CapTop=True)
face_normal = AnalyzeFaceNormal(MolaMesh=cone)
pdecon = Deconstruct(Point=face_normal)  # -> XComponent, YComponent, ZComponent
equals = Equality(FirstNumber=pdecon.ZComponent, SecondNumber=0)  # -> Equality, Inequality
split = MeshSplit(MolaMesh=cone, BooleanList=equals.Equality)  # -> MolaMesh1, MolaMesh2
face_normal_2 = AnalyzeFaceNormal(MolaMesh=split.MolaMesh2)
face_modulo = AnalyzeFaceModulo(MolaMesh=split.MolaMesh1, Modulo=2, N=0)
pdecon_2 = Deconstruct(Point=face_normal_2)  # -> XComponent, YComponent, ZComponent
equals_2 = Equality(FirstNumber=pdecon_2.ZComponent, SecondNumber=-1)  # -> Equality, Inequality
split_2 = MeshSplit(MolaMesh=split.MolaMesh1, BooleanList=face_modulo)  # -> MolaMesh1, MolaMesh2
split_3 = MeshSplit(MolaMesh=split.MolaMesh2, BooleanList=equals_2.Equality)  # -> MolaMesh1, MolaMesh2
extrude = SubdivideExtrude(MolaMesh=split_2.MolaMesh1, Height=5, Cap=True, Iteration=1)
face_normal_3 = AnalyzeFaceNormal(MolaMesh=extrude)
pdecon_3 = Deconstruct(Point=face_normal_3)  # -> XComponent, YComponent, ZComponent
equals_3 = Equality(FirstNumber=pdecon_3.ZComponent, SecondNumber=-1)  # -> Equality, Inequality
split_4 = MeshSplit(MolaMesh=extrude, BooleanList=equals_3.Equality)  # -> MolaMesh1, MolaMesh2
join = MeshJoin(MolaMeshes=[split_3.MolaMesh1, split_4.MolaMesh1])
topology = UpdateTopology(MolaMesh=join)
catmullclark = SubdivideCatmullClark(MolaMesh=topology, Iteration=1)
extrude_tapered = SubdivideExtrudeTapered(MolaMesh=catmullclark, Height=Slider(-10, range=-10..-9), Fraction=0, Cap=False, Iteration=1)
face_location = AnalyzeFaceLocation(MolaMesh=extrude_tapered)
dist = Distance(PointA="{0,0,0}", PointB=face_location)
sort = SortList(Keys=dist)  # -> Keys, ValuesA
larger = LargerThan(FirstNumber=dist, SecondNumber=Slider(6.147, range=0..13))  # -> LargerThan, OrEqualTo
split_5 = MeshSplit(MolaMesh=extrude_tapered, BooleanList=larger.LargerThan)  # -> MolaMesh1, MolaMesh2
to_rhino = MolaToRhino(MolaMesh=split_5.MolaMesh1, WithColor=True)
panel = Panel(sort.Keys)
